# Grasshopper definition Stippler_Grasshopperdevelopment_DEV_PUBLIC.gh (Grasshopper 1.0.8)

# ---- group: __GH_DEVELOPMENT_TOOLS__
# DEPENDENCIES
# (PLUGINS USED)
plugins = BooleanToggle(False)
definitiondependencies = DefinitionDependencies(Toggle=plugins)  # -> Core, AddOns; inputs Toggle: Boolean
# ---------- definitiondependencies: C# ----------
#region Usings
using System;
using System.Linq;
using System.Collections;
using System.Collections.Generic;
using System.Drawing;

using Rhino;
using Rhino.Geometry;

using Grasshopper;
using Grasshopper.Kernel;
using Grasshopper.Kernel.Data;
using Grasshopper.Kernel.Types;
#endregion

public class Script_Instance : GH_ScriptInstance
{
    #region Notes
    /* 
      Members:
        RhinoDoc RhinoDocument
        GH_Document GrasshopperDocument
        IGH_Component Component
        int Iteration

      Methods (Virtual & overridable):
        Print(string text)
        Print(string format, params object[] args)
        Reflect(object obj)
        Reflect(object obj, string method_name)

    Author: Giulio Piacentino (updated by Anders Holden Deleuran , updated 2025 by Max Benjamin Eschenbach)
    License: Apache License 2.0
    Version: 251010
    */
    #endregion

    private void RunScript(bool Toggle, ref object Core, ref object AddOns)
    {   
        // set component params
        this.Component.Name = "DefinitionDependencies";
        this.Component.NickName = "DefinitionDependencies";
        this.Component.Category = "DDU_CSC";
        this.Component.SubCategory = "0 Development";
        this.Component.Description = (
            "Identifies and lists all core and add-on Grasshopper libraries " +
            "used in the current Grasshopper document. Categorizes libraries " +
            "and returns their names and versions.");

        List<string> coreLibs = new List<string>();
        List<string> addLibs = new List<string>();
        if (Toggle)
        {
            Dictionary<string, GH_AssemblyInfo> coreLibraries = new Dictionary<string, GH_AssemblyInfo>();
            Dictionary<string, GH_AssemblyInfo> addonLibraries = new Dictionary<string, GH_AssemblyInfo>();
            Dictionary<string, string> objids = new Dictionary<string, string>();
            GH_ComponentServer server = Grasshopper.Instances.ComponentServer;
            foreach (GH_DocumentObject obj in this.Component.OnPingDocument().Objects)
            {
                if (obj == (GH_DocumentObject) this.Component)
                {
                    continue;
                }
                string objid = obj.ComponentGuid.ToString();
                if (objids.ContainsKey(objid)) continue;
                GH_AssemblyInfo lib = server.FindAssemblyByObject(obj);
                if (lib == null) continue;
                if (coreLibraries.ContainsKey(lib.Id.ToString()) | addonLibraries.ContainsKey(lib.Id.ToString())) continue;
                if (lib.IsCoreLibrary) coreLibraries.Add(lib.Id.ToString(), lib);
                else addonLibraries.Add(lib.Id.ToString(), lib);
            }
            foreach(KeyValuePair<string, GH_AssemblyInfo> entry in coreLibraries)
            {
                coreLibs.Add($"{entry.Value.Name} {entry.Value.Version}");
            }
            foreach(KeyValuePair<string, GH_AssemblyInfo> entry in addonLibraries)
            {
                addLibs.Add($"{entry.Value.Name} {entry.Value.Version}");
            }
        }
        Core = coreLibs;
        AddOns = addLibs;
    }
}
# ---------- end definitiondependencies ----------
grasshoppe_core_libraries = Panel(definitiondependencies.Core)
addon_libraries = Panel(definitiondependencies.AddOns)

# ----
# 1 -> CREATE PUBLIC DEV FILE
# comments & notes: Use this to create a public version without secrets from this development file. The component will create an in-memory copy of the GH Document, then clear all Panels which names are in "ClearPanelNames" and then save the document to the DevelopmentPath.
panel_names_to_clear = Panel("")
development_folder = Panel("..\grasshopper_development")
filename = Panel("Stippler_Grasshopperdevelopment_DEV_PUBLIC")
run = Button()
createpublicdevelopmentfile = CreatePublicDevelopmentFile(Run=run, ClearPanelNames=panel_names_to_clear, DevelopmentPath=development_folder, Filename=filename)  # -> out, Success, SavedFilePath, Status; inputs Run: Boolean, ClearPanelNames: list of String, DevelopmentPath: String, Filename: String
# ---------- createpublicdevelopmentfile: Python ----------
#! python3
# -*- coding: utf-8 -*-
# venv: DDU_CSC
print('ENV OK!')
# r: charset_normalizer
# r: requests

# PYTHON STANDARD LIBRARY IMPORTS ---------------------------------------------
import os  # NOQA
from datetime import datetime  # NOQA

# RHINO AND GH RELATED IMPORTS ------------------------------------------------
import System  # NOQA
import Grasshopper  # NOQA
import Rhino  # NOQA
import scriptcontext as sc  # NOQA

# GHENV COMPONENT SETTINGS ----------------------------------------------------
ghenv.Component.Name = 'CreatePublicDevelopmentFile'  # NOQA
ghenv.Component.NickName = 'CreatePublicDevelopmentFile'  # NOQA
ghenv.Component.Category = 'DDU_CSC'  # NOQA
ghenv.Component.SubCategory = '0 Development'  # NOQA
ghenv.Component.Description = (  # NOQA
    """
    This component can be used to create a sanitized Grasshopper
    development file in a specified folder.

    It creates a copy of the current Grasshopper document in
    memory, removes all components that belong to a specified group (i.e.
    developmclears specified panels containing sensitive information,
    and saves the modified document to a specified folder.

    The folder path can be relative, i.e. "..\\grasshopper_release".

    The filename can be specified, otherwise a timestamp-based filename will be
    generated.
    """
)


class CSC_CreatePublicDevelopmentFile(Grasshopper.Kernel.GH_ScriptInstance):
    """
    Author: Max Benjamin Eschenbach
    License: MIT License
    Version: 260609
    """

    def __init__(self):
        """Initialize this component and set component parameters."""
        super().__init__()
        # initialize props
        self.Component = ghenv.Component  # NOQA
        self.InputParams = self.Component.Params.Input
        self.OutputParams = self.Component.Params.Output

    def _addRemark(self, msg: str = ''):
        """Add a remark message to the component."""
        rml = self.Component.RuntimeMessageLevel.Remark
        self.AddRuntimeMessage(rml, msg)

    def _addWarning(self, msg: str = ''):
        """Add a warning message to the component."""
        rml = self.Component.RuntimeMessageLevel.Warning
        self.AddRuntimeMessage(rml, msg)

    def _addError(self, msg: str = ''):
        """Add an error message to the component."""
        rml = self.Component.RuntimeMessageLevel.Error
        self.AddRuntimeMessage(rml, msg)

    def BeforeRunScript(self):
        """Performs some setup actions."""
        # Initialize input param descriptions
        self.InputParams[0].Description = (
            'Run the document copy, object removal, and save operation'
        )
        self.InputParams[1].Description = (
            'List of names of optional GH_Panel objects to clear,'
            ' (i.e. for passwords)'
        )
        self.InputParams[2].Description = (
            'Folder path where to save the modified development document'
        )
        self.InputParams[3].Description = (
            'Optional filename for the saved document '
            '(without .gh extension)'
        )
        # Initialize output param descriptions
        i = 0
        if self.OutputParams[0].Name == 'out':
            i += 1
        self.OutputParams[0+i].Description = (
            'Success status of the operation (True/False)'
        )
        self.OutputParams[1+i].Description = (
            'Full path of the saved document'
        )
        self.OutputParams[2+i].Description = (
            'Status message describing the operation result'
        )

    def copy_document(self, source_doc):
        """
        Create a copy of the Grasshopper document in memory.

        Args:
            source_doc: The source Grasshopper document to copy

        Returns:
            GH_Document: A copy of the source document, or None if failed
        """
        try:
            if source_doc is None:
                self._addError('Source document is None')
                return None

            # Use the DuplicateDocument method to create a copy
            duplicate_doc = Grasshopper.Kernel.GH_Document.DuplicateDocument(
                source_doc
            )

            if duplicate_doc is None:
                self._addError('Failed to duplicate the document')
                return None

            self._addRemark('Successfully created document copy')
            return duplicate_doc

        except Exception as e:
            self._addError(f'Error copying document: {str(e)}')
            return None

    def clear_panels(self, doc, target_panels):
        """
        Clear all GH_Panel instances in the document with one of the specified
        names.
        """
        panels_cleared = 0
        try:
            # loop over target panels and clear them
            for panel in target_panels:
                # UserText property holds the panel contents so we clear it
                panel.UserText = ''
                # we clear the volatile data as well
                panel.ClearData()
                panels_cleared += 1
        except Exception as e:
            self._addError(f'Error clearing panels: {str(e)}')
            return panels_cleared
        # return target groups and objects
        return panels_cleared

    def find_panels_to_clear(self, doc, panel_names=[]):
        """
        Find all panels in the document with the specified name.
        """
        # get type for panels as string for verification
        paneltype = Grasshopper.Kernel.Special.GH_Panel
        paneltype_str = str(paneltype).split("'")[1]
        # loop over all document objects
        doc_objects = doc.Objects
        target_panels = []
        try:
            for doc_obj in doc_objects:
                # ensure matching panel name
                if panel_names and doc_obj.NickName in panel_names:
                    # ensure matching type
                    if str(doc_obj.GetType()) == paneltype_str:
                        target_panels.append(doc_obj)
        except Exception as e:
            self._addError(f'Error finding panels: {str(e)}')
            return None
        # return target panels
        return target_panels

    def save_document(self, doc, save_path, filename=None):
        """
        Save the Grasshopper document to the specified path.

        Args:
            doc: The Grasshopper document to save
            save_path: The folder path where to save the document
            filename: Optional filename
                      (if None, generates timestamp-basedname)

        Returns:
            bool: True if successful, False otherwise
        """
        try:
            if doc is None:
                self._addError('Document is None, cannot save')
                return False, ''

            if not save_path:
                self._addError('Save path is empty')
                return False, ''

            # Handle relative paths - get the current GH
            # document directory as base
            current_doc = self.Component.OnPingDocument()
            if current_doc and current_doc.FilePath:
                current_dir = os.path.dirname(current_doc.FilePath)
                # Convert relative path to absolute path
                if not os.path.isabs(save_path):
                    save_path = os.path.normpath(
                        os.path.join(current_dir, save_path)
                    )
            else:
                # If no current document, use current working directory
                save_path = os.path.abspath(os.path.normpath(save_path))

            # Ensure the save directory exists
            if not os.path.exists(save_path):
                try:
                    os.makedirs(save_path, exist_ok=True)
                    self._addRemark(f'Created directory: {save_path}')
                except Exception as e:
                    self._addError(
                        f'Failed to create directory {save_path}: '
                        f'{str(e)}'
                    )
                    return False, ''

            # Generate filename if not provided
            if not filename:
                timestamp = datetime.now().strftime('%y%m%d_%H%M%S')
                filename = f'{timestamp}_ReleaseFile.gh'

            # Ensure filename has .gh extension
            if not filename.endswith('.gh'):
                filename += '.gh'

            # Create full file path
            full_path = os.path.join(save_path, filename)

            # Use GH_DocumentIO to save the document
            # (following SaveAndSaveGHX pattern)
            doc_io = Grasshopper.Kernel.GH_DocumentIO(doc)

            # Save the document
            success = doc_io.SaveQuiet(full_path)

            if success:
                self._addRemark(f'Document saved successfully: {full_path}')
                return True, full_path
            else:
                self._addError(f'Failed to save document to: {full_path}')
                return False, ''
        except Exception as e:
            self._addError(f'Error saving document: {str(e)}')
            return False, ''

    def validate_inputs(self, clear_panel_names, save_path):
        """
        Validate the input parameters.

        Args:
            save_path: The path where to save the document

        Returns:
            bool: True if inputs are valid, False otherwise
        """
        if not save_path or not save_path.strip():
            self._addError('Save path cannot be empty')
            return False

        if not clear_panel_names:
            clear_panel_names = []
        for cpn in clear_panel_names:
            if not isinstance(cpn, str):
                self._addError('ClearPanelNames contains non-string')
                return False

        # Check if save path is valid
        try:
            # Handle relative paths - get the current
            # GH document directory as base
            current_doc = self.Component.OnPingDocument()
            if current_doc and current_doc.FilePath:
                current_dir = os.path.dirname(current_doc.FilePath)
                # Convert relative path to absolute path
                if not os.path.isabs(save_path):
                    normalized_path = os.path.normpath(
                        os.path.join(current_dir, save_path)
                    )
                else:
                    normalized_path = os.path.normpath(save_path)
            else:
                # If no current document, use current working directory
                normalized_path = os.path.abspath(os.path.normpath(save_path))
            # Check if the parent directory exists or can be created
            parent_dir = os.path.dirname(normalized_path)
            if parent_dir and not os.path.exists(parent_dir):
                # Try to create the parent directory
                try:
                    os.makedirs(parent_dir, exist_ok=True)
                except Exception:
                    self._addError(f'Cannot create directory: {parent_dir}')
                    return False
        except Exception as e:
            self._addError(f'Invalid save path: {str(e)}')
            return False

        return True

    def RunScript(self,
            Run: bool,
            ClearPanelNames: System.Collections.Generic.List[str],
            DevelopmentPath: str,
            Filename: str):

        # Initialize output variables
        success = False
        saved_file_path = ''
        status_message = ''

        # Check if execution is requested
        if not Run:
            status_message = 'Run is False - operation not performed'
            self.Component.Message = status_message
            return (success, saved_file_path,
                    status_message)

        # Validate inputs
        if not self.validate_inputs(
                ClearPanelNames, DevelopmentPath):
            status_message = 'Input validation failed'
            self.Component.Message = status_message
            return (success, saved_file_path,
                    status_message)

        # Get the current Grasshopper document
        current_doc = self.Component.OnPingDocument()
        if current_doc is None:
            status_message = 'No active Grasshopper document found'
            self._addError(status_message)
            self.Component.Message = status_message
            return (success, saved_file_path,
                    status_message)

        # Step 1: Copy the current document
        self.Component.Message = 'Copying document...'
        copied_doc = self.copy_document(current_doc)
        if copied_doc is None:
            status_message = 'Failed to copy document'
            self.Component.Message = status_message
            return (success, saved_file_path,
                    status_message)

        # Step 2: Find the panels to clear
        self.Component.Message = 'Finding groups...'
        target_panels = self.find_panels_to_clear(
            copied_doc, ClearPanelNames
        )

        # Step 3: Clear Panels if ClearPanelNames were supplied
        if target_panels:
            self.Component.Message = 'Clearing Panels...'
            panels_cleared = self.clear_panels(copied_doc, target_panels)
            if panels_cleared == 0:
                status_message = ('No panels have been cleared!')
                self._addWarning(status_message)

        # Step 4: Save the modified document
        self.Component.Message = 'Saving document...'
        save_success, saved_file_path = self.save_document(
            copied_doc,
            DevelopmentPath,
            Filename
        )
        if save_success:
            saved_file_path = os.path.normpath(
                os.path.abspath(saved_file_path)
            )
            success = True
            status_message += (
                f'\n Saved development file to: {saved_file_path}'
            )
            self.Component.Message = 'Operation completed successfully'
        else:
            status_message += '\n Failed to save document!'
            self.Component.Message = 'Save operation failed'

        # set message
        self.Component.Message = 'Operation completed successfully'
        # return results
        return (success, saved_file_path, status_message)
# ---------- end createpublicdevelopmentfile ----------
status_message_stream = Panel(createpublicdevelopmentfile.Status)
success_message = Panel(createpublicdevelopmentfile.Success)
filepath_of_saved_release_file = Panel(createpublicdevelopmentfile.SavedFilePath)

run_2 = BooleanToggle(False)
openfile = BooleanToggle(True)
width = Slider(720, range=0..10000)
height = Slider(480, range=0..10000)
# __DEVELOPMENT_CREDITS__: Authors: Max Benjamin Eschenbach
# 
# Digital Design Unit (DDU)
# Prof. Dr.-Ing. Oliver Tessmann
# Fachbereich Architektur
# Technical University of Darmstadt
# 
# CREDITS:
# ------------
toggle = BooleanToggle(False)
outputformat = ValueList({"PNG": 0, "SVF": 1, "PDF": 2}, selected="PNG")
# ENVIRONMENT SPEC: #! python3
# # -*- coding: utf-8 -*-
# # venv: STIPPLER
# print('ENV OK!')
# # r: charset_normalizer
# # r: git+https://github.com/fstwn/stippler.git@python39-rhino-port#subdirectory=code
number_slider = Slider(42, range=0..1000)
boundary = BooleanToggle(False)
silhouettedensity = BooleanToggle(False)
interior = BooleanToggle(True)
lighting = BooleanToggle(False)
depthattenuation = BooleanToggle(False)
gradientsize = BooleanToggle(False)
silhouettecurves = BooleanToggle(True)
source_folder = Panel("..\grasshopper_userobjects_xml")

# ---- group: __GH_DEVELOPMENT_TOOLS__
# SCRIPT SOURCE & USROBJ EXPORT
user_s_userobjects_folder = Panel("%APPDATA%\Grasshopper\UserObjects\Stippler")
ddu_development_userobjects_folder = Panel("..\grasshopper_userobjects")
source_folder_2 = Panel("..\grasshopper_userobjects_src")
icons_folder = Panel("..\resources\gh_icons\24x24")
placeholder_icon_path = Panel("..\resources\gh_icons\placeholder\250820_csc_icon_24x24.png")
category = Panel("STIPPLER")
exportscriptsandsource = ExportScriptsAndSource(
    RunComponentAnalysis=Toggle(False),
    ExportUserObjectsAndSource=Toggle(False),
    Category=category,
    UserObjFolders=[ddu_development_userobjects_folder, user_s_userobjects_folder],
    XMLFolders=source_folder,
    SourceFolders=source_folder_2,
    IconsFolder=icons_folder,
    PlaceholderIconPath=placeholder_icon_path)  # -> out, OldScriptsDebug, CategoryDebug, VersionDebug, InfoMessages, UpdateMessages; inputs RunComponentAnalysis: Boolean, ExportUserObjectsAndSource: Boolean, Category: String, UserObjFolders: list of String, XMLFolders: list of String, SourceFolders: list of String, IconsFolder: String, PlaceholderIconPath: String
# ---------- exportscriptsandsource: Python ----------
#! python3
# -*- coding: utf-8 -*-
# venv: DDU_CSC
print('ENV OK!')
# r: charset_normalizer
# r: requests

# PYTHON STANDARD LIBRARY IMPORTS ---------------------------------------------
import os  # NOQA
import re  # NOQA
from functools import cmp_to_key  # NOQA

# RHINO AND GH RELATED IMPORTS ------------------------------------------------
import System  # NOQA
import Rhino  # NOQA
import Grasshopper  # NOQA
import GH_IO  # NOQA
import scriptcontext as sc  # NOQA
import GhPython as ghpy  # NOQA
import ScriptComponents as scomp  # NOQA
import RhinoCodePluginGH as rcpgh  # NOQA

# GHENV COMPONENT SETTINGS ----------------------------------------------------
ghenv.Component.Name = "ExportScriptsAndSource"  # NOQA
ghenv.Component.NickName = "ExportScriptsAndSource"  # NOQA
ghenv.Component.Category = "DDU_CSC"  # NOQA
ghenv.Component.SubCategory = "0 Development"  # NOQA
ghenv.Component.Description = (  # NOQA
    'Analyzes the current Grasshopper document to identify script components, '
    'extracts their source code, and can export them as Grasshopper User '
    'Objects (.ghuser) and raw source files (.py, .c'
)


class ExportScriptsAndSource(Grasshopper.Kernel.GH_ScriptInstance):
    """
    Author: Max Benjamin Eschenbach (based on a Python Script by Anders Holden Deleuran)  # NOQA
    License: MIT License
    Version: 260609
    """

    def __init__(self):
        """Initialize this component and set component parameters."""
        super().__init__()
        # initialize props
        self.Component = ghenv.Component  # NOQA
        self.InputParams = self.Component.Params.Input
        self.OutputParams = self.Component.Params.Output

    def _addRemark(self, msg: str = ''):
        """Add a remark message to the component."""
        rml = self.Component.RuntimeMessageLevel.Remark
        self.AddRuntimeMessage(rml, msg)

    def _addWarning(self, msg: str = ''):
        """Add a warning message to the component."""
        rml = self.Component.RuntimeMessageLevel.Warning
        self.AddRuntimeMessage(rml, msg)

    def _addError(self, msg: str = ''):
        """Add an error message to the component."""
        rml = self.Component.RuntimeMessageLevel.Error
        self.AddRuntimeMessage(rml, msg)

    def BeforeRunScript(self):
        """Perform some setup actions."""
        # Initialize input param descriptions
        self.InputParams[0].Description = (
            'Run the analysis of all scriptable components within '
            'the document.\n'
            'Updates all recognized \'old\' script versions '
            'to the latest available script version within the doc.'
        )
        self.InputParams[1].Description = (
            'Export scripts as source files and UserObjects.\n'
            'NOTE: Only runs if RunComponentAnalysis is True!'
        )
        self.InputParams[2].Description = (
            'Target category for component export. Will only '
            'export components that have this category set.'
        )
        self.InputParams[3].Description = (
            'Folders to save UserObjects in.\n'
            'NOTE: Resolves environment variables and relative'
            'paths based on the GH document.'
        )
        self.InputParams[4].Description = (
            'Folders to save \'pasteable\' XML representations '
            'of UserObjects in.\n'
            'NOTE: Resolves environment variables and relative'
            'paths based on the GH document.'
        )
        self.InputParams[5].Description = (
            'Folder to save script source files in.\n'
            'NOTE: Resolves environment variables and relative'
            'paths based on the GH document.'
        )
        self.InputParams[6].Description = (
            'Folder containing 24x24 PNG icons named {NickName}.png. '
            'Supply the path to the 24x24 directory relative to the '
            'GH document (e.g. ../resources/gh_icons/24x24).\n'
            'NOTE: Resolves environment variables and relative paths '
            'based on the GH document.'
        )
        self.InputParams[7].Description = (
            'Path to a placeholder 24x24 PNG used when no matching '
            '{NickName}.png is found in IconsFolder.\n'
            'NOTE: Resolves environment variables and relative paths '
            'based on the GH document.'
        )
        # Initialize output param descriptions
        i = 0
        if self.OutputParams[0].Name == 'out':
            i += 1
        self.OutputParams[0+i].Description = (
            'Debug messages concerning deprecated script components.'
        )
        self.OutputParams[1+i].Description = (
            'Debug messages concerning different categories.'
        )
        self.OutputParams[2+i].Description = (
            'Debug messages concerning script versions.'
        )
        self.OutputParams[3+i].Description = (
            'General info messages'
        )
        self.OutputParams[4+i].Description = (
            'Messages concering replaced script sources '
            '(updated components)'
        )

    def get_source_version(self, source):
        """
        Attempts to get the first instance of the word "version"
        (or, "Version") in a multi line string. Then attempts to extract a
        version string from this line where the word "version" exists.
        Supports formats like:
            Version: 160121
            Version: 251009.1
            Version: 251009a
        """
        # Get first line with version in it
        src_lower = source.lower()
        version_str = [ln for ln in src_lower.split('\n') if "version" in ln]
        if version_str:
            # Extract version string using regex to handle complex formats
            # Look for patterns like: 251009, 251009.1, 251009a, etc.
            version_match = re.search(
                r'(\d+(?:\.\d+)?[a-zA-Z]?)', version_str[0])
            if version_match:
                version_text = version_match.group(1)
                return self._parse_version_string(version_text)
        return None

    def _parse_version_string(self, version_str):
        """
        Parse a version string into a comparable format.
        Handles formats like: 251009, 251009.1, 251009a

        Returns a tuple that can be used for comparison:
        - (251009,) for "251009"
        - (251009, 1) for "251009.1"
        - (251009, 0, 'a') for "251009a"
        """
        # Split into base number and suffix
        match = re.match(r'(\d+)(?:\.(\d+))?([a-zA-Z]*)', version_str)
        if not match:
            return None

        base_num = int(match.group(1))
        dot_num = int(match.group(2)) if match.group(2) else 0
        letter_suffix = match.group(3).lower() if match.group(3) else ''

        # Convert letter to number for comparison (a=1, b=2, etc.)
        letter_num = ord(letter_suffix) - ord('a') + 1 if letter_suffix else 0

        return (base_num, dot_num, letter_num)

    def _compare_versions(self, version1, version2):
        """
        Compare two version tuples.

        Returns:
            -1 if version1 < version2
             0 if version1 == version2
             1 if version1 > version2
        """
        if version1 is None and version2 is None:
            return 0
        if version1 is None:
            return -1
        if version2 is None:
            return 1

        # Compare tuple elements in order
        for i in range(max(len(version1), len(version2))):
            v1_elem = version1[i] if i < len(version1) else 0
            v2_elem = version2[i] if i < len(version2) else 0

            if v1_elem < v2_elem:
                return -1
            elif v1_elem > v2_elem:
                return 1

        return 0

    def _expand_path(self, path):
        """
        Expand environment variables in a path string.
        Handles %APPDATA%, %USERPROFILE%, %TEMP%, etc.
        """
        if not path:
            return path
        return os.path.expandvars(path)

    def _build_icon_dict(self, iconsfolder, gh_dir):
        """
        Map component NickName -> absolute path of a 24x24 PNG icon.

        ``iconsfolder`` must be the path to the 24x24 directory (relative
        to the GH document). Only regular ``.png`` files are indexed.
        """
        icon_dict = {}
        if not iconsfolder:
            return icon_dict

        resolved = os.path.normpath(os.path.abspath(
            os.path.join(gh_dir, self._expand_path(iconsfolder))))
        if not os.path.isdir(resolved):
            self._addWarning(f'Icons folder not found: {resolved}')
            return icon_dict

        for name in os.listdir(resolved):
            if not name.lower().endswith('.png'):
                continue
            icon_file = os.path.join(resolved, name)
            if not os.path.isfile(icon_file):
                continue
            icon_key = os.path.splitext(name)[0]
            icon_dict[icon_key] = os.path.normpath(
                os.path.abspath(icon_file))

        if not icon_dict:
            self._addWarning(f'No PNG icons found in {resolved}')
        return icon_dict

    def _read_png_bitmap(self, iconpath):
        """Read one PNG file into a GDI+ bitmap (or None on failure)."""
        with open(iconpath, 'rb') as icon_file:
            data = icon_file.read()
        if len(data) < 8 or data[:4] != b'\x89PNG':
            return None
        stream = System.IO.MemoryStream()
        stream.Write(bytearray(data), 0, len(data))
        stream.Position = 0
        bitmap = System.Drawing.Bitmap(stream)
        stream.Dispose()
        return bitmap

    def _load_icon_bitmap(self, iconpath):
        """
        Load a 24x24 PNG for Grasshopper.

        Uses a memory stream instead of ``Bitmap.FromFile`` so GDI+ does not
        lock the file and so cairosvg-exported PNGs load reliably on Windows.
        """
        if not iconpath or not os.path.isfile(iconpath):
            return None
        try:
            return self._read_png_bitmap(iconpath)
        except Exception as exc:
            self._addWarning(f'Could not load icon {iconpath}: {exc}')
            return None

    def process_document_objects(self, ghdocument, verbose=False):
        """
        Processes GH_Document object and return a list of all script components
        """
        # get all document objects
        comps = list(ghdocument.Objects)

        # types of python components
        ghpycomp = ghpy.Component.ZuiPythonComponent
        ipycomp = rcpgh.Components.IronPython2Component
        py3comp = rcpgh.Components.Python3Component

        # types of csharp components
        cscomp = scomp.Component_CSNET_Script
        cs9comp = rcpgh.Components.CSharpComponent

        # cluster component
        clustercomp = Grasshopper.Kernel.Special.GH_Cluster

        # extract component type strings
        ghpycomp_str = str(ghpycomp).split("'")[1]
        cscomp_str = str(cscomp).split("'")[1]
        ipycomp_str = str(ipycomp).split("'")[1]
        py3comp_str = str(py3comp).split("'")[1]
        cs9comp_str = str(cs9comp).split("'")[1]
        clustercomp_str = str(clustercomp).split("'")[1]

        # define script types
        id_ghpycomp = 'GHPY'
        id_cscomp = 'CS'
        id_ipycomp = 'IPY2'
        id_py3comp = 'PY3'
        id_cs9comp = 'CS9'

        # init dict for script component storage
        script_components = {}

        # loop over all document components
        # store all component objects in a dictionary to check
        # - are all "same" scripts the same code?
        # - are there scripts without category or version attribute?
        # - separate old from new scripts, dont export old scripts!
        for obj in comps:
            # extract basic info
            name = obj.Name
            nickname = obj.NickName
            iguid = str(obj.InstanceGuid)
            # extract type string
            objtype_str = str(obj.GetType())
            # OLD GHPYTHON COMPONENT
            if objtype_str == ghpycomp_str:
                source = obj.Code
                if source:
                    if verbose:
                        print(
                            (f'Found Source for OLD GHPY Component '
                             f'"{nickname}" ({iguid})'))
                    scriptcomp = [id_ghpycomp, nickname, name, obj, source]
                    script_components[iguid] = scriptcomp
            # OLD C# COMPONENT
            elif objtype_str == cscomp_str:
                source = obj.ScriptSource.ScriptCode
                if source:
                    if verbose:
                        print(
                            (f'Found Source for OLD CS Component "{nickname}" '
                             f'({iguid})'))
                    scriptcomp = [id_cscomp, nickname, name, obj, source]
                    script_components[iguid] = scriptcomp
            # NEW C#9 COMPONENT
            elif objtype_str == cs9comp_str:
                bres, source = obj.TryGetSource()
                if bres:
                    if verbose:
                        print((f'Found Source for CS9 Component "{nickname}" '
                               f'({iguid})'))
                    scriptcomp = [id_cs9comp, nickname, name, obj, source]
                    script_components[iguid] = scriptcomp
            # NEW IRONPYTHON COMPONENT
            elif objtype_str == ipycomp_str:
                bres, source = obj.TryGetSource()
                if bres:
                    if verbose:
                        print((f'Found Source for IPY2 Component "{nickname}" '
                               f'({iguid})'))
                    scriptcomp = [id_ipycomp, nickname, name, obj, source]
                    script_components[iguid] = scriptcomp
            # NEW PYTHON3 COMPONENT
            elif objtype_str == py3comp_str:
                bres, source = obj.TryGetSource()
                if bres:
                    if verbose:
                        print((f'Found Source for PY3 Component "{nickname}" '
                               f'({iguid})'))
                    scriptcomp = [id_py3comp, nickname, name, obj, source]
                    script_components[iguid] = scriptcomp
            # CLUSTER COMPONENT
            elif objtype_str == clustercomp_str:
                # RECURSIVELY STEP THROUGH CLUSTERS AND LOOK FOR SCRIPTS ...
                if verbose:
                    print((f'Processing CLUSTER "{nickname}" ({name}, '
                           f'{iguid}) ...'))
                cluster_scripts = self.process_document_objects(
                    obj.Document(''), verbose=verbose
                )
                # add cluster script dict to main dict
                script_components.update(cluster_scripts)
        # return results
        return script_components

    def _replace_scriptcomp_source(
            self, old_script_comp_values, new_source):
        """
        Replaces source code of gh scriptable components.
        """
        # extract data
        script_type, nickname, name, obj, source, iconpath = old_script_comp_values
        # check for type and decide action
        if (script_type == "PY3" or
                script_type == 'IPY2' or
                script_type == 'CS9'):
            # set the source code
            obj.SetSource(new_source)
            # infer component param inputs from RunScript signature
            obj.SetParametersFromScript()
            # call parameter maintenance helper
            obj.VariableParameterMaintenance()
            rml = obj.RuntimeMessageLevel.Warning
            msg = 'My source just got replaced with a new version!'
            obj.AddRuntimeMessage(rml, msg)
        elif script_type == 'GHPY':
            return False
        elif script_type == 'CS':
            return False
        return True

    def process_script_components(
            self,
            script_components: dict,
            set_category: str,
            icon_dict: dict,
            placeholder_icon_path: str = ''):
        """
        Process found script components and get unique components.
        """

        OldScriptsDebug = []
        CategoryDebug = []
        VersionDebug = []
        InfoMessages = []
        UpdateMessages = []

        versioned_script_components = {}
        unique_script_components = {}

        for iguid, values in script_components.items():
            # extract data from dict object
            script_type, nickname, name, obj, source = values
            category = obj.Category
            version = self.get_source_version(source)
            category_match = category == set_category
            version_present = version is not None
            # append icon path to values list (placeholder when no match)
            values.append(
                icon_dict.get(nickname, '') or placeholder_icon_path)
            # script id will be used as key for the unique dict
            script_id = nickname + '_' + name + '_' + script_type
            # NOT SEEN YET SCRIPT COMPONENTS
            if script_id not in versioned_script_components:
                version_present = version is not None
                if script_type == 'GHPY':
                    OldScriptsDebug.append(
                        f'{script_type} - {nickname} ({name})')
                    OldScriptsDebug.append(
                        '    - IS AN OLD GHPYTHON SCRIPT!')
                elif script_type == 'CS':
                    OldScriptsDebug.append(
                        f'{script_type} - {nickname} ({name})')
                    OldScriptsDebug.append('    - IS AN OLD C# SCRIPT!')
                if not category_match:
                    # create debug info messages
                    if category == 'Maths':
                        CategoryDebug.append(
                            f'{script_type} - {nickname} ({name})')
                        CategoryDebug.append(
                            f'    - HAS NO CATEGORY ({category}) (No Export)!')
                    else:
                        CategoryDebug.append(
                            f'{script_type} - {nickname} ({name})')
                        CategoryDebug.append(
                            f'    - {category} OUT OF SET CATEGORY '
                            f'{set_category} (No Export)!')
                if not version_present:
                    # create debug info messages
                    VersionDebug.append(
                        ' '.join([script_type, nickname, name]))
                    VersionDebug.append('    - HAS NO VERSION! (No Export)')
                if category_match and version_present:
                    InfoMessages.append(f'{script_type} - {nickname} ({name})')
                    versioned_script_components[script_id] = [values]
            # ALREADY SEEN SCRIPT COMPONENTS
            else:
                existing_source = versioned_script_components[script_id][0][4]
                existing_version = self.get_source_version(existing_source)
                if version is None:
                    VersionDebug.append(f'{script_type} - {nickname} ({name})')
                    VersionDebug.append('    - HAS NO VERSION!')
                    # NO VERSION, CONTINUE!
                    continue
                elif existing_version is None and version is not None:
                    VersionDebug.append(f'{script_type} - {nickname} ({name})')
                    VersionDebug.append(
                        f'    - VERSION {version} > ALREADY FOUND VERSION '
                        f'{existing_version}!')
                    # REPLACE FOUND "NONE" VERSION WITH NAMED VERSION!
                    raise NotImplementedError(
                        'Correcting missing Version is not implemented yet!'
                    )
                elif self._compare_versions(version, existing_version) < 0:
                    VersionDebug.append(f'{script_type} - {nickname} ({name})')
                    VersionDebug.append(
                        f'    - VERSION {version} < {existing_version}! '
                        'Updating Source...')
                    versioned_script_components[script_id].append(values)
                elif self._compare_versions(version, existing_version) > 0:
                    VersionDebug.append(f'{script_type} - {nickname} ({name})')
                    VersionDebug.append(
                        f'    - VERSION {version} > ALREADY FOUND VERSION '
                        f'{existing_version}!')
                    versioned_script_components[script_id].append(values)
        # LOOP OVER VERSIONED COMPONENTS AND UPDATE OLD SOURCES
        # THEN UPDATE UNIQUE COMPONENT DICT
        for script_id, versioned_comps in versioned_script_components.items():
            # check if multiple versions were found
            if len(versioned_comps) == 1:
                # ONLY ONE VERSION -> ADD TO UNIQUE DICT
                unique_script_components[script_id] = versioned_comps[0]
            else:
                # MULTIPLE VERSIONS -> SORT, CHECK AND DECIDE
                versions = [self.get_source_version(vc[4])
                            for vc in versioned_comps]
                sorted_versions, sorted_comps = zip(*sorted(
                    zip(versions, versioned_comps),
                    key=cmp_to_key(
                        lambda x, y: self._compare_versions(x[0], y[0])
                    ),
                    reverse=True
                ))
                # convert to lists
                sorted_versions = list(sorted_versions)
                sorted_comps = list(sorted_comps)
                # pop latest script version
                latest_version = sorted_versions.pop(0)
                latest_comp = sorted_comps.pop(0)
                latest_source = latest_comp[4]
                # loop over remaining (older) versions and replace source
                for k, old_comp in enumerate(sorted_comps):
                    # REPLACE THE SOURCE OF THE LOWER VERSIONS
                    # WITH LATEST VERSIONS SOURCE!
                    repres = self._replace_scriptcomp_source(
                        old_comp,
                        latest_source,
                    )
                    if repres:
                        UpdateMessages.append(
                            f'Updated source for {latest_comp[1]}: '
                            f'{sorted_versions[k]} -> {latest_version}'
                        )
                    # replace old icons with new icons
                    # old_comp[3].Icon = latest_comp[3].Icon
                # THEN UPDATE DICT!
                UpdateMessages.append(
                    f'Updated in Dict: {latest_comp[0]} - '
                    f'{latest_comp[1]} ({sorted_versions[k]} '
                    f'-> {latest_version})'
                )
                unique_script_components[script_id] = latest_comp
        # return unique result dict and message arrays
        return (unique_script_components, OldScriptsDebug, CategoryDebug,
                VersionDebug, InfoMessages, UpdateMessages)

    def make_userobject(self, obj, iconpath=''):
        """
        Creates a UserObject from a GH document object
        """
        # Make a user object
        uo = Grasshopper.Kernel.GH_UserObject()
        bitmap = self._load_icon_bitmap(iconpath)
        if bitmap is not None:
            obj.SetIconOverride(bitmap)
        uo.Icon = obj.Icon_24x24
        # Set its properties based on the GHPython component properties
        uo.BaseGuid = obj.ComponentGuid
        uo.Exposure = obj.Exposure.primary
        uo.Description.Name = obj.Name
        uo.Description.NickName = obj.NickName
        uo.Description.Description = obj.Description
        uo.Description.Category = obj.Category
        uo.Description.SubCategory = obj.SubCategory
        # Set the user object data and save to file
        uo.SetDataFromObject(obj)
        return uo

    def export_scriptcomp_usrobj(self, scriptcomp, usrobjpath, iconpath=''):
        """
        Automates the creation of a GHPython user object. Based on this thread:
        http://www.grasshopper3d.com/forum/topics/change-the-default-values-for-userobject-popup-menu
        scriptcomp = [script_type, nickname, name, obj, source, iconpath]
        """
        try:
            # Make a user object
            obj = scriptcomp[3]
            uo = self.make_userobject(obj, iconpath)
            uo.Path = os.path.join(
                usrobjpath, obj.Category + '_' + obj.Name + '.ghuser')
            # Ensure the directory exists before saving
            os.makedirs(usrobjpath, exist_ok=True)
            uo.SaveToFile()
        except Exception as e:
            print(e)
            return False
        return True

    def export_scriptcomp_xml(self, scriptcomp, xmlpath, iconpath=''):
        """
        Export scriptable component as 'pasteable' XML
        """
        try:
            obj = scriptcomp[3]
            uo = self.make_userobject(obj, iconpath)
            # instantiate userobject to finally get a copy of the
            # DocumentObject and set new instanceguid (precaution)
            uo_comp = uo.InstantiateObject()
            uo_comp.NewInstanceGuid()
            # overwrite object location on canvas
            uo_comp.Attributes.Pivot = System.Drawing.PointF(20, 20)
            # create new doc and add object
            new_doc = Grasshopper.Kernel.GH_Document()
            new_doc.AddObject(uo_comp, False, 0)
            # create archive that can be serialized
            archive = GH_IO.Serialization.GH_Archive()
            archive.AppendObject(new_doc, 'Clipboard')
            # last but not least: serialize to XML - hooray!
            xml = archive.Serialize_Xml()
            xml = xml.replace('\r', '')
            if not os.path.isdir(xmlpath):
                os.makedirs(xmlpath)
            xmlfile = os.path.join(
                xmlpath, obj.Category + '_' + obj.Name + '.xml'
            )
            with open(xmlfile, 'w') as f:
                f.write(xml)
        except Exception as e:
            print(e)
            return False
        return True

    def export_scriptcomp_source(self, scriptcomp, srcpath):
        """
        Export the source code of a script component
        scriptcomp = [script_type, nickname, name, obj, source]
        """
        # Get code and lines of code
        try:
            script_type = scriptcomp[0]
            name = scriptcomp[2]
            obj = scriptcomp[3]
            source = scriptcomp[4]
            code = source.replace('\r', '')
            lines = code.splitlines()
            loc = len(lines)
            # Check/make source file folder
            srcpath = os.path.join(srcpath)
            if not os.path.isdir(srcpath):
                os.makedirs(srcpath)
            # Write code to file
            if script_type == 'PY3' or script_type == 'IPY2':
                ext = '.py'
            elif script_type == 'CS9':
                ext = '.cs'
            else:
                # DO NOT EXPORT OLD SCRIPTS!
                ext = None
            if ext:
                src_file = os.path.join(
                    srcpath, obj.Category + '_' + name + ext
                )
                with open(src_file, 'w') as f:
                    f.write(code)
        except Exception as e:
            print(e)
            return False, None
        return True, loc

    def RunScript(self,
            RunComponentAnalysis: bool,
            ExportUserObjectsAndSource: bool,
            Category: str,
            UserObjFolders: System.Collections.Generic.List[str],
            XMLFolders: System.Collections.Generic.List[str],
            SourceFolders: System.Collections.Generic.List[str],
            IconsFolder: str,
            PlaceholderIconPath: str):
        # Init outputs
        OldScriptsDebug = Grasshopper.DataTree[str]()
        CategoryDebug = Grasshopper.DataTree[str]()
        VersionDebug = Grasshopper.DataTree[str]()
        InfoMessages = Grasshopper.DataTree[str]()
        UpdateMessages = Grasshopper.DataTree[str]()

        # Iterate the canvas and get to the GHPython components
        grasshopper_document = ghenv.Component.OnPingDocument()  # type: ignore[reportUnedfinedVariable] # NOQA
        gh_dir = os.path.dirname(grasshopper_document.FilePath)

        usrobjpaths = [
            os.path.normpath(os.path.abspath(
                os.path.join(gh_dir, self._expand_path(uof))))
            for uof in UserObjFolders]
        xmlpaths = [os.path.normpath(
            os.path.abspath(os.path.join(
                gh_dir, self._expand_path(xmlf))))
            for xmlf in XMLFolders]
        srcpaths = [os.path.normpath(
            os.path.abspath(os.path.join(
                gh_dir, self._expand_path(srcf))))
            for srcf in SourceFolders]
        icon_dict = self._build_icon_dict(IconsFolder, gh_dir)
        placeholder_icon_path = ''
        if PlaceholderIconPath:
            placeholder_icon_path = os.path.normpath(os.path.abspath(
                os.path.join(gh_dir, self._expand_path(PlaceholderIconPath))))

        if RunComponentAnalysis:
            # loop over all objects on the grasshopper canvas
            # and identify the components to export scriptsource from
            script_components = self.process_document_objects(
                grasshopper_document, verbose=False)

            # - are all "same" scripts the same code?
            # - are there scripts without category or version attribute?
            # - separate old from new scripts, dont export old scripts!
            (unique_script_components,
             OldScriptsDebug,
             CategoryDebug,
             VersionDebug,
             InfoMessages,
             UpdateMessages) = self.process_script_components(
                script_components, Category, icon_dict,
                placeholder_icon_path)

        # HERE LOOP OVER UNIQUE COMPONENTS
        if ExportUserObjectsAndSource and RunComponentAnalysis:
            for script_id, scriptcomp in unique_script_components.items():
                unionres = True
                iconpath = scriptcomp[5]
                # SAVE SOURCE IN ALL PATHS
                for src_path in srcpaths:
                    res, loc = self.export_scriptcomp_source(
                        scriptcomp, src_path
                    )
                    if not res:
                        unionres = False
                        break
                # SAVE XML FILES
                for xml_path in xmlpaths:
                    res = self.export_scriptcomp_xml(
                        scriptcomp, xml_path, iconpath
                    )
                    if not res:
                        unionres = False
                        break
                # SAVE USEROBJECT IN ALL PATHS
                for uo_path in usrobjpaths:
                    res = self.export_scriptcomp_usrobj(
                        scriptcomp, uo_path, iconpath
                    )
                    if not res:
                        unionres = False
                        break
                if unionres:
                    print(f'Exported: {scriptcomp[1]} - {loc} Lines of Code')
                else:
                    raise RuntimeError(f'Export failed for {scriptcomp[1]}!')
        elif ExportUserObjectsAndSource and not RunComponentAnalysis:
            rml = ghenv.Component.RuntimeMessageLevel.Warning  # type: ignore[reportUnedfinedVariable] # NOQA
            ghenv.Component.AddRuntimeMessage(  # type: ignore[reportUnedfinedVariable] # NOQA
                rml,
                'UserObjects and Source cannot be exported without running '
                'Component Analysis!')

        return (OldScriptsDebug, CategoryDebug,
                VersionDebug, InfoMessages, UpdateMessages)
# ---------- end exportscriptsandsource ----------
print_out = Panel(exportscriptsandsource.out)
oldscriptsdebug = Panel(exportscriptsandsource.OldScriptsDebug)
categorydebug = Panel(exportscriptsandsource.CategoryDebug)
versiondebug = Panel(exportscriptsandsource.VersionDebug)
infomessages = Panel(exportscriptsandsource.InfoMessages)
updatemessages = Panel(exportscriptsandsource.UpdateMessages)

# ----
stippledviewcapture = StippledViewCapture(
    Toggle=run_2,
    OpenFile=openfile,
    Width=width,
    Height=height,
    BackgroundColor=ColourSwatch(SwatchColor=RGB(255, 255, 255)),
    Grid=Toggle(False),
    WorldAxes=toggle,
    CPlaneAxes=Toggle(False),
    OutputFormat=outputformat,
    NumDots=Slider(60000, range=0..100000),
    Iterations=Slider(12, range=0..100),
    Gamma=Slider(1, range=0..10),
    RMin=Slider(1, range=0..10),
    RMax=Slider(6, range=0..10),
    SizeJitter=Slider(0.15, range=0..1),
    PositionJitter=Slider(0.1, range=0..1),
    EdgeNoise=Slider(0.1, range=0..1),
    Seed=number_slider,
    Dpi=Slider(300, range=0..1000),
    Boundary=boundary,
    SilhouetteDensity=silhouettedensity,
    Interior=interior,
    Lighting=lighting,
    DepthAttenuation=depthattenuation,
    GradientSize=gradientsize,
    SilhouetteCurves=silhouettecurves,
    CurveWidth=Slider(0.5, range=0..1))  # -> StippledPath, CapturePath, NormalPath, DepthPath; inputs Toggle: Boolean, OpenFile: Boolean, Width: Int32, Height: Int32, BackgroundColor: Color, Grid: Boolean, WorldAxes: Boolean, CPlaneAxes: Boolean, OutputFormat: Int32, NumDots: Int32, Iterations: Int32, Gamma: Double, RMin: Double, RMax: Double, SizeJitter: Double, PositionJitter: Double, EdgeNoise: Double, Seed: Int32, Dpi: Int32, Boundary: Boolean, SilhouetteDensity: Boolean, Interior: Boolean, Lighting: Boolean, DepthAttenuation: Boolean, GradientSize: Boolean, SilhouetteCurves: Boolean, NormalMap: String, DepthMap: String, LightDir: Vector3d, CurveWidth: Double
# ---------- stippledviewcapture: Python ----------
#! python3
# -*- coding: utf-8 -*-
# venv: STIPPLER
print('ENV OK!')
# r: charset_normalizer
# r: git+https://github.com/fstwn/stippler.git@python39-rhino-port#subdirectory=code


# PYTHON STANDARD LIBRARY IMPORTS ---------------------------------------------
import os  # NOQA
import datetime  # NOQA

# RHINO AND GH RELATED IMPORTS ------------------------------------------------
import System  # NOQA
import Rhino  # NOQA
import Grasshopper  # NOQA
import scriptcontext as sc  # NOQA

from stippler import (  # NOQA
    IllustrationParams,
    stipple,
    render_matplotlib,
    render_svg,
)

OUTPUT_FORMATS = {
    0: '.png',
    1: '.svg',
    2: '.pdf',
}

# GHENV COMPONENT SETTINGS ----------------------------------------------------
ghenv.Component.Name = 'StippledViewCapture'  # NOQA
ghenv.Component.NickName = 'StippledViewCapture'  # NOQA
ghenv.Component.Category = 'STIPPLER'  # NOQA
ghenv.Component.SubCategory = '1 Stippled Visualization'  # NOQA
ghenv.Component.Description = (  # NOQA
    'Captures the active Rhino viewport to PNG, then runs the stippler '
    'pipeline and writes a second file with the _stippled suffix. Supports '
    'PNG, SVG, and PDF stipple output, capture dimensions, background color, '
    'viewport visibility options, hand-drawn stippling controls, and '
    'optional Lu et al. scientific-illustration enhancements. Depth and '
    'normal auxiliary maps are captured automatically when the options that '
    'need them are enabled.'
)


class StippledViewCapture(Grasshopper.Kernel.GH_ScriptInstance):
    """
    Author: Max Benjamin Eschenbach
    License: MIT License
    Version: 260630
    """

    def __init__(self):
        super().__init__()
        self.Component = ghenv.Component  # NOQA
        self.InputParams = self.Component.Params.Input
        self.OutputParams = self.Component.Params.Output

    def _addRemark(self, msg: str = ''):
        """Add a remark message to the component runtime messages."""
        rml = self.Component.RuntimeMessageLevel.Remark
        self.AddRuntimeMessage(rml, msg)

    def _addWarning(self, msg: str = ''):
        """Add a warning message to the component runtime messages."""
        rml = self.Component.RuntimeMessageLevel.Warning
        self.AddRuntimeMessage(rml, msg)

    def _addError(self, msg: str = ''):
        """Add an error message to the component runtime messages."""
        rml = self.Component.RuntimeMessageLevel.Error
        self.AddRuntimeMessage(rml, msg)

    def _colorToHex(self, color):
        if color is None:
            return 'white'
        return '#%02x%02x%02x' % (color.R, color.G, color.B)

    def _resolveOptionalPath(self, path):
        if path is None:
            return None
        text = str(path).strip()
        if not text:
            return None
        return text

    def _needsDepthCapture(self, depth_attenuation, depth_override):
        return bool(depth_attenuation) and not depth_override

    def _needsNormalCapture(self, silhouette_density, lighting,
                            silhouette_curves, normal_override):
        if normal_override:
            return False
        return bool(silhouette_density or lighting or silhouette_curves)

    def _viewDirectionFromActiveView(self):
        """Return unit camera-to-target direction as (x, y, z)."""
        sc.escape_test()
        sc.doc = Rhino.RhinoDoc.ActiveDoc
        view = sc.doc.Views.ActiveView
        ghdoc = self.Component.OnPingDocument()
        sc.doc = ghdoc  # NOQA
        if view is None:
            return (0.0, 0.0, 1.0)
        camera = view.ActiveViewport.CameraLocation
        target = view.ActiveViewport.CameraTarget
        direction = target - camera
        if direction.IsTiny:
            direction = view.ActiveViewport.CameraZ
        direction.Unitize()
        return (direction.X, direction.Y, direction.Z)

    def _vector3dToTuple(self, vector, default=(1.0, 1.0, 1.0)):
        if vector is None:
            return default
        length = vector.Length
        if length < 1e-12:
            return default
        return (vector.X / length, vector.Y / length, vector.Z / length)

    def _buildIllustrationParams(
            self,
            boundary,
            silhouette_density,
            interior,
            lighting,
            depth,
            gradient_size,
            silhouette_curves,
            light_dir,
            view_dir,
            curve_width):
        return IllustrationParams(
            boundary=bool(boundary),
            silhouette_density=bool(silhouette_density),
            interior=bool(interior),
            lighting=bool(lighting),
            depth=bool(depth),
            gradient_size=bool(gradient_size),
            silhouette_curves=bool(silhouette_curves),
            light=light_dir,
            view=view_dir,
        ), curve_width

    def checkOrMakeFolder(self):
        """
        Check/makes a "Captures" folder in the GH def folder and a subfolder
        in the format 'YYMMDD'.
        """
        sc.escape_test()
        ghdoc = self.Component.OnPingDocument()
        date = datetime.date.today()
        yy = str(date.year)[-2:]
        mm = str(date.month).zfill(2)
        dd = str(date.day).zfill(2)
        timestamp = yy + mm + dd
        docpath = ghdoc.FilePath  # NOQA
        if docpath:
            folder = os.path.dirname(docpath)
            captureFolder = folder + "\\Captures\\" + timestamp
            if not os.path.isdir(captureFolder):
                os.makedirs(captureFolder)
            return captureFolder

    def makeFileName(self):
        """ Make a string with the gh def name + current hourMinuteSecond """
        n = datetime.datetime.now()
        ho, mt, sec = str(n.hour), str(n.minute), str(n.second)
        if len(ho) == 1:
            ho = "0" + ho
        if len(mt) == 1:
            mt = "0" + mt
        if len(sec) == 1:
            sec = "0" + sec
        hms = ho + mt + sec
        ghdoc = self.Component.OnPingDocument()
        ghDef = ghdoc.DisplayName.strip('*')
        return ghDef + '_' + hms

    def _resolveOutputFormat(self, format_code):
        if format_code is None:
            format_code = 0
        ext = OUTPUT_FORMATS.get(int(format_code))
        if ext is None:
            raise Exception(
                'OutputFormat must be 0 (PNG), 1 (SVG), or 2 (PDF).'
            )
        return ext

    def _viewCaptureBitmap(self, width, height, grid, world_axes, cplane_axes):
        """
        Capture the active Rhino view; caller must set sc.doc to RhinoDoc.
        """
        sc.escape_test()
        activeView = sc.doc.Views.ActiveView
        if activeView is None:
            raise Exception('No active Rhino viewport to capture.')
        viewcap = Rhino.Display.ViewCapture()
        viewcap.DrawGrid = grid
        viewcap.DrawGridAxes = world_axes
        viewcap.DrawAxes = cplane_axes
        viewcap.Height = height
        viewcap.Width = width
        bitmap = viewcap.CaptureToBitmap(activeView)
        if bitmap is None:
            raise Exception('ViewCapture returned an empty bitmap.')
        return bitmap

    def _saveBitmap(self, bitmap, path):
        bitmap.Save(path, System.Drawing.Imaging.ImageFormat.Png)

    def _captureWithToggleCommand(self, command, width, height, path):
        """
        Toggle a Rhino display command, ViewCapture, then toggle off.
        """
        sc.escape_test()
        ghdoc = self.Component.OnPingDocument()
        sc.doc = Rhino.RhinoDoc.ActiveDoc
        toggled_on = False
        try:
            if not Rhino.RhinoApp.RunScript(command, False):
                raise Exception('Rhino command failed: %s' % command)
            toggled_on = True
            bitmap = self._viewCaptureBitmap(
                width,
                height,
                False,
                False,
                False
            )
            self._saveBitmap(bitmap, path)
            Rhino.RhinoApp.WriteLine(path)
            return path
        finally:
            if toggled_on:
                Rhino.RhinoApp.RunScript(command, False)
            sc.doc = ghdoc  # NOQA

    def captureActiveViewToFile(
            self,
            width,
            height,
            path,
            grid,
            worldAxes,
            cplaneAxes):
        """Capture the shaded beauty pass."""
        sc.escape_test()
        ghdoc = self.Component.OnPingDocument()
        sc.doc = Rhino.RhinoDoc.ActiveDoc
        try:
            bitmap = self._viewCaptureBitmap(
                width, height, grid, worldAxes, cplaneAxes)
            self._saveBitmap(bitmap, path)
            Rhino.RhinoApp.WriteLine(path)
            sc.doc = ghdoc  # NOQA
            return path
        except Exception as e:
            sc.doc = ghdoc  # NOQA
            raise Exception(f'Capture failed, check the path: {str(e)}')

    def captureDepthMap(self, width, height, path):
        """Capture a grayscale depth map via ShowZBuffer + ViewCapture."""
        self._addRemark('Capturing depth map (ShowZBuffer)...')
        return self._captureWithToggleCommand(
            '_ShowZBuffer',
            width,
            height,
            path
        )

    def captureNormalMap(self, width, height, path):
        """Capture an RGB normal map via TestShowNormalMap + ViewCapture."""
        self._addRemark(
            'Capturing normal map (TestShowNormalMap). '
            'Monochrome or Arctic display mode works best.'
        )
        return self._captureWithToggleCommand(
            '_TestShowNormalMap', width, height, path)

    def stippleCapture(
            self,
            capture_path,
            output_path,
            output_ext,
            n_point,
            n_iter,
            gamma,
            r_min,
            r_max,
            size_jitter,
            position_jitter,
            edge_noise,
            seed,
            dpi,
            background,
            illustration,
            normal_map,
            depth_map,
            curve_width):
        """Run stippler on the capture and write the stippled output file."""
        sc.escape_test()
        result = stipple(
            capture_path,
            n_point=n_point,
            n_iter=n_iter,
            gamma=gamma,
            r_min=r_min,
            r_max=r_max,
            size_jitter=size_jitter,
            position_jitter=position_jitter,
            edge_noise=edge_noise,
            seed=seed,
            illustration=illustration,
            normal_map=normal_map,
            depth_map=depth_map,
        )
        if output_ext == '.svg':
            render_svg(
                result,
                output_path,
                background=background,
                curve_width=curve_width,
            )
        else:
            render_matplotlib(
                result,
                output_path,
                dpi=dpi,
                background=background,
                curve_width=curve_width,
            )
        return output_path, len(result.points), len(result.curves)

    def _setInputDescriptions(self):
        descriptions = [
            'Toggle to execute capture and stippling',
            'Open the stippled output file after creation',
            'Image width in pixels (default: 1920)',
            'Image height in pixels (default: 1080)',
            'Background color for the viewport capture and stipple output',
            'Show grid in the captured image',
            'Show world axes in the captured image',
            'Show construction plane axes in the captured image',
            'Stipple output format: 0=PNG (default), 1=SVG, 2=PDF',
            'Number of stipple dots (default: 5000)',
            ('Max Lloyd relaxation iterations; lower = '
             'looser spacing (default: 50)'),
            ('Density contrast curve; >1 concentrates '
             'dots in dark areas (default: 1.0)'),
            'Minimum dot radius in density-pixel units (default: 1.0)',
            'Maximum dot radius in density-pixel units (default: 1.0)',
            'Per-dot radius noise as a fraction, e.g. 0.15 (default: 0.0)',
            ('Gaussian positional noise std in '
             'density-pixel units (default: 0.0)'),
            ('Dot-edge wobble as a fraction of '
             'radius, e.g. 0.08 (default: 0.0)'),
            ('Random seed; 0 or less uses a '
             'non-deterministic seed (default: 0)'),
            'Raster output DPI for PNG/PDF stipple output (default: 300)',
            'Boost stipple density on high-gradient edges (Lu et al.)',
            'Boost density on silhouette regions; auto-captures normal map',
            'Sparse stipples in flat/low-gradient regions (Lu et al.)',
            'Modulate density from surface lighting; auto-captures normal map',
            'Attenuate far regions; auto-captures depth map (Lu et al.)',
            'Scale dot radius by local gradient magnitude (Lu et al.)',
            'Draw silhouette curves; auto-captures normal map when enabled',
            'Optional normal-map override path (skip auto-capture when set)',
            'Optional depth-map override path (skip auto-capture when set)',
            'Light direction for lighting enhancement (default: 1,1,1)',
            'Silhouette curve stroke width in output pixels (default: 0.6)',
        ]
        for index, text in enumerate(descriptions):
            if index < self.InputParams.Count:
                self.InputParams[index].Description = text

    def RunScript(self,
            Toggle: bool,
            OpenFile: bool,
            Width: int,
            Height: int,
            BackgroundColor: System.Drawing.Color,
            Grid: bool,
            WorldAxes: bool,
            CPlaneAxes: bool,
            OutputFormat: int,
            NumDots: int,
            Iterations: int,
            Gamma: float,
            RMin: float,
            RMax: float,
            SizeJitter: float,
            PositionJitter: float,
            EdgeNoise: float,
            Seed: int,
            Dpi: int,
            Boundary: bool,
            SilhouetteDensity: bool,
            Interior: bool,
            Lighting: bool,
            DepthAttenuation: bool,
            GradientSize: bool,
            SilhouetteCurves: bool,
            NormalMap: str,
            DepthMap: str,
            LightDir: Rhino.Geometry.Vector3d,
            CurveWidth: float):
        self._setInputDescriptions()
        self.OutputParams[0].Description = (
            'Path to the stippled output file (<name>_stippled.<ext>)'
        )
        if self.OutputParams.Count > 1:
            self.OutputParams[1].Description = (
                'Path to the original viewport capture PNG'
            )
        if self.OutputParams.Count > 2:
            self.OutputParams[2].Description = (
                'Path to the auto-captured normal map (<name>_normal.png), '
                'if created'
            )
        if self.OutputParams.Count > 3:
            self.OutputParams[3].Description = (
                'Path to the auto-captured depth map (<name>_depth.png), '
                'if created'
            )

        StippledPath = Grasshopper.DataTree[System.Object]()
        CapturePath = Grasshopper.DataTree[System.Object]()
        NormalPath = Grasshopper.DataTree[System.Object]()
        DepthPath = Grasshopper.DataTree[System.Object]()

        if not Toggle:
            self.Component.Message = (
                'Ready to capture view (toggle to execute)'
            )
            return StippledPath, CapturePath, NormalPath, DepthPath

        try:
            if BackgroundColor:
                settings = Rhino.ApplicationSettings.AppearanceSettings
                settings.ViewportBackgroundColor = BackgroundColor
                self._addRemark('Background color set for capture')

            if not Width:
                Width = 1920
            if not Height:
                Height = 1080
            if not NumDots:
                NumDots = 5000
            if not Iterations:
                Iterations = 50
            stipple_ext = self._resolveOutputFormat(OutputFormat)
            if Gamma is None:
                Gamma = 1.0
            if RMin is None:
                RMin = 1.0
            if RMax is None:
                RMax = 1.0
            if SizeJitter is None:
                SizeJitter = 0.0
            if PositionJitter is None:
                PositionJitter = 0.0
            if EdgeNoise is None:
                EdgeNoise = 0.0
            if not Dpi:
                Dpi = 300
            if CurveWidth is None or CurveWidth <= 0:
                CurveWidth = 0.6

            seed = Seed if Seed and Seed > 0 else None
            background = self._colorToHex(BackgroundColor)
            normal_map = self._resolveOptionalPath(NormalMap)
            depth_map = self._resolveOptionalPath(DepthMap)
            view_dir = self._viewDirectionFromActiveView()
            light_dir = self._vector3dToTuple(LightDir)

            capture_depth = self._needsDepthCapture(
                DepthAttenuation, depth_map)
            capture_normal = self._needsNormalCapture(
                SilhouetteDensity, Lighting, SilhouetteCurves, normal_map)

            illustration, curve_width = self._buildIllustrationParams(
                Boundary,
                SilhouetteDensity,
                Interior,
                Lighting,
                DepthAttenuation and (capture_depth or bool(depth_map)),
                GradientSize,
                SilhouetteCurves,
                light_dir,
                view_dir,
                CurveWidth,
            )

            self.Component.Message = 'Preparing capture...'

            capFolder = self.checkOrMakeFolder()
            if not capFolder:
                raise Exception(
                    'Save the Grasshopper definition first so a capture '
                    'folder can be created.'
                )

            fileName = self.makeFileName()
            capture_path = os.path.join(capFolder, fileName + '.png')
            depth_path = os.path.join(capFolder, fileName + '_depth.png')
            normal_path = os.path.join(capFolder, fileName + '_normal.png')
            stipple_path = os.path.join(
                capFolder, fileName + '_stippled' + stipple_ext
            )

            self.Component.Message = 'Capturing beauty pass...'
            captured_path = self.captureActiveViewToFile(
                Width, Height, capture_path, Grid, WorldAxes, CPlaneAxes
            )
            self._addRemark(f'Captured beauty pass to {captured_path}')

            if capture_depth:
                self.Component.Message = 'Capturing depth map...'
                depth_map = self.captureDepthMap(Width, Height, depth_path)
                self._addRemark(f'Captured depth map to {depth_map}')

            if capture_normal:
                self.Component.Message = 'Capturing normal map...'
                normal_map = self.captureNormalMap(Width, Height, normal_path)
                self._addRemark(f'Captured normal map to {normal_map}')

            self.Component.Message = 'Stippling...'
            output_path, dot_count, curve_count = self.stippleCapture(
                captured_path,
                stipple_path,
                stipple_ext,
                NumDots,
                Iterations,
                Gamma,
                RMin,
                RMax,
                SizeJitter,
                PositionJitter,
                EdgeNoise,
                seed,
                Dpi,
                background,
                illustration,
                normal_map,
                depth_map,
                curve_width,
            )
            self._addRemark(
                f'Stippled {dot_count} dots and {curve_count} curves to '
                f'{output_path}'
            )

            ghp = Grasshopper.Kernel.Data.GH_Path(0)
            StippledPath.Add(output_path, ghp)
            CapturePath.Add(captured_path, ghp)
            if normal_map:
                NormalPath.Add(normal_map, ghp)
            if depth_map:
                DepthPath.Add(depth_map, ghp)

            if OpenFile:
                os.startfile(output_path)
                self._addRemark('Stippled file opened')

            self.Component.Message = (
                f'Saved: {dot_count} dots, {curve_count} curves'
            )
            Rhino.RhinoApp.WriteLine(captured_path)
            if depth_map:
                Rhino.RhinoApp.WriteLine(depth_map)
            if normal_map:
                Rhino.RhinoApp.WriteLine(normal_map)
            Rhino.RhinoApp.WriteLine(output_path)
            return StippledPath, CapturePath, NormalPath, DepthPath

        except Exception as e:
            msg = f'Capture/stipple failed: {str(e)}'
            self._addError(msg)
            self.Component.Message = msg
            return StippledPath, CapturePath, NormalPath, DepthPath
# ---------- end stippledviewcapture ----------

# ---- group: __GH_DEVELOPMENT_TOOLS__
# 2 -> CREATE RELEASE FILES
# comments & notes: Use this to create the release files from the current development file. The component will create an in-memory copy of the GH Document, then remove all components that have the "RemoveGroupName" assigned, clear Panels which names are in "ClearPanelNames" and then save the document to the ReleasePath
release_folder = Panel("..\grasshopper_release")
filename_2 = Panel("Stippler_0.2.0.0")
panel_names_to_clear_2 = Panel("")
name_of_groups_to_remove_from_release_fi = Panel("__GH_DEVELOPMENT_TOOLS__")  # "Name of Groups to Remove from Release File"
saveexamplesonly = BooleanToggle(False)
run_3 = Button()
createreleasefiles = CreateReleaseFiles(
    Run=run_3,
    SaveExamplesOnly=saveexamplesonly,
    RemoveGroupName=name_of_groups_to_remove_from_release_fi,
    ClearPanelNames=panel_names_to_clear_2,
    ReleasePath=release_folder,
    Filename=filename_2)  # -> out, Success, Removed, SavedFilePath, Status; inputs Run: Boolean, SaveExamplesOnly: Boolean, RemoveGroupName: String, ClearPanelNames: list of String, ReleasePath: String, Filename: String, ExampleGroupNames: list of String, ExampleFileNames: list of String
# ---------- createreleasefiles: Python ----------
#! python3
# -*- coding: utf-8 -*-
# venv: DDU_CSC
print('ENV OK!')
# r: charset_normalizer
# r: requests

# PYTHON STANDARD LIBRARY IMPORTS ---------------------------------------------
import os  # NOQA
from datetime import datetime  # NOQA

# RHINO AND GH RELATED IMPORTS ------------------------------------------------
import System  # NOQA
import Grasshopper  # NOQA
import Rhino  # NOQA
import scriptcontext as sc  # NOQA

# GHENV COMPONENT SETTINGS ----------------------------------------------------
ghenv.Component.Name = 'CreateReleaseFiles'  # NOQA
ghenv.Component.NickName = 'CreateReleaseFiles'  # NOQA
ghenv.Component.Category = 'DDU_CSC'  # NOQA
ghenv.Component.SubCategory = '0 Development'  # NOQA
ghenv.Component.Description = (  # NOQA
    """
    This component can be used to create a Grasshopper release file in a
    separate folder.

    It creates a copy of the current Grasshopper document in
    memory, removes all components that belong to a specified group (i.e.
    development components), and saves the modified document to a specified
    folder.

    The folder path can be relative, i.e. "..\\grasshopper_release".

    The filename can be specified, otherwise a timestamp-based filename will be
    generated.
    """
)


class CSC_CreateReleaseFiles(Grasshopper.Kernel.GH_ScriptInstance):
    """
    Author: Max Benjamin Eschenbach
    License: MIT License
    Version: 260609
    """

    def __init__(self):
        """Initialize this component and set component parameters."""
        super().__init__()
        # initialize props
        self.Component = ghenv.Component  # NOQA
        self.InputParams = self.Component.Params.Input
        self.OutputParams = self.Component.Params.Output

    def _addRemark(self, msg: str = ''):
        """Add a remark message to the component."""
        rml = self.Component.RuntimeMessageLevel.Remark
        self.AddRuntimeMessage(rml, msg)

    def _addWarning(self, msg: str = ''):
        """Add a warning message to the component."""
        rml = self.Component.RuntimeMessageLevel.Warning
        self.AddRuntimeMessage(rml, msg)

    def _addError(self, msg: str = ''):
        """Add an error message to the component."""
        rml = self.Component.RuntimeMessageLevel.Error
        self.AddRuntimeMessage(rml, msg)

    def BeforeRunScript(self):
        """Performs some setup actions."""
        # Initialize input param descriptions
        self.InputParams[0].Description = (
            'Run the document copy, object removal, and save operation'
        )
        self.InputParams[1].Description = (
            'Name of the group(s) to remove for relese file'
        )
        self.InputParams[2].Description = (
            'List of names of optional GH_Panel objects to clear,'
            ' (i.e. for passwords)'
        )
        self.InputParams[3].Description = (
            'Folder path where to save the modified release document'
        )
        self.InputParams[4].Description = (
            'Optional filename for the saved document '
            '(without .gh extension)'
        )
        # Initialize output param descriptions
        i = 0
        if self.OutputParams[0].Name == 'out':
            i += 1
        self.OutputParams[0+i].Description = (
            'Success status of the operation (True/False)'
        )
        self.OutputParams[1+i].Description = (
            'Number of components removed'
        )
        self.OutputParams[2+i].Description = (
            'Full path of the saved document'
        )
        self.OutputParams[3+i].Description = (
            'Status message describing the operation result'
        )

    def copy_document(self, source_doc):
        """
        Create a copy of the Grasshopper document in memory.

        Args:
            source_doc: The source Grasshopper document to copy

        Returns:
            GH_Document: A copy of the source document, or None if failed
        """
        try:
            if source_doc is None:
                self._addError('Source document is None')
                return None

            # Use the DuplicateDocument method to create a copy
            duplicate_doc = Grasshopper.Kernel.GH_Document.DuplicateDocument(
                source_doc
            )

            if duplicate_doc is None:
                self._addError('Failed to duplicate the document')
                return None

            self._addRemark('Successfully created document copy')
            return duplicate_doc

        except Exception as e:
            self._addError(f'Error copying document: {str(e)}')
            return None

    def clear_panels(self, doc, target_panels):
        """
        Find all GH_Panel instances in the document with one of the specified
        names and clear them.
        """
        panels_cleared = 0
        try:
            # loop over target panels and clear them
            for panel in target_panels:
                # UserText property holds the panel contents so we clear it
                panel.UserText = ''
                # we clear the volatile data as well
                panel.ClearData()
                panels_cleared += 1
        except Exception as e:
            self._addError(f'Error clearing panels: {str(e)}')
            return panels_cleared
        # return target groups and objects
        return panels_cleared

    def find_groups_and_objects(self, doc, group_name, panel_names=[]):
        """
        Find all groups and objects in the document with the specified name.
        """
        # get type for groups as string for verification
        grouptype = Grasshopper.Kernel.Special.GH_Group
        grouptype_str = str(grouptype).split("'")[1]
        # get type for panels as string for verification
        paneltype = Grasshopper.Kernel.Special.GH_Panel
        paneltype_str = str(paneltype).split("'")[1]
        # loop over all document objects
        doc_objects = doc.Objects
        target_groups = []
        target_objects = []
        target_panels = []
        try:
            for doc_obj in doc_objects:
                # ensure matching group name
                if doc_obj.NickName == group_name:
                    # ensure matching type
                    if str(doc_obj.GetType()) == grouptype_str:
                        target_groups.append(doc_obj)
                        for grp_obj in doc_obj.Objects():
                            target_objects.append(grp_obj)
                elif panel_names and doc_obj.NickName in panel_names:
                    # ensure matching type
                    if str(doc_obj.GetType()) == paneltype_str:
                        target_panels.append(doc_obj)
        except Exception as e:
            self._addError(f'Error finding groups and objects: {str(e)}')
            return None, None, None
        # return target groups and objects
        return target_groups, target_objects, target_panels

    def remove_all_groups_and_objects_except(
            self,
            doc,
            group_name,
            keep_sketches=True):
        """
        Find all groups and objects in the document except
        the ones with the specified name.
        """
        # get type for groups as string for verification
        grouptype = Grasshopper.Kernel.Special.GH_Group
        grouptype_str = str(grouptype).split("'")[1]
        # sketch type
        sketchtype = Grasshopper.Kernel.Special.GH_Markup
        sketchtype_str = str(sketchtype).split("'")[1]
        # get type for panels as string for verification
        paneltype = Grasshopper.Kernel.Special.GH_Panel
        paneltype_str = str(paneltype).split("'")[1]
        # loop over all document objects
        doc_objects = list(doc.Objects)
        target_objects = []
        try:
            for doc_obj in doc_objects:
                # keep sketches (ddu logo etc.)
                if keep_sketches and str(doc_obj.GetType()) == sketchtype_str:
                    target_objects.append(doc_obj)
                    continue
                if (str(doc_obj.GetType()) == paneltype_str and
                        doc_obj.NickName == '__DEVELOPMENT_CREDITS__'):
                    target_objects.append(doc_obj)
                    continue
                # ensure matching group name
                if doc_obj.NickName == group_name:
                    # ensure matching type
                    if str(doc_obj.GetType()) == grouptype_str:
                        # get the translation vector
                        tx = - float(doc_obj.Attributes.Bounds.X) + 100.0
                        ty = - float(doc_obj.Attributes.Bounds.Y) + 100.0
                        target_objects.append(doc_obj)
                        for grp_obj in doc_obj.Objects():
                            pos = grp_obj.Attributes.Pivot
                            pos_x = float(pos.X) + tx
                            pos_y = float(pos.Y) + ty
                            grp_obj.Attributes.Pivot = System.Drawing.PointF(
                                pos_x,
                                pos_y
                            )
                            target_objects.append(grp_obj)
            objects_to_remove = [o for o in doc_objects
                                 if o not in target_objects]
            comps_removed = self.remove_objects_from_doc(
                doc,
                objects_to_remove
            )
        except Exception as e:
            self._addError(f'Error removing groups and objects: {str(e)}')
            return None
        return comps_removed

    def remove_objects_from_doc(self, doc, objects, groups=None):
        """
        Remove objects from the document.
        """
        components_removed = 0
        try:
            # loop over objects and remove them
            for obj in objects:
                doc.RemoveObject(obj, True)
                components_removed += 1
            # loop over groups and remove them
            if groups:
                for grp in groups:
                    doc.RemoveObject(grp, True)
                    components_removed += 1
        except Exception as e:
            self._addError(f'Error removing objects from document: {str(e)}')
            return 0
        # return number of components removed
        return components_removed

    def save_document(self, doc, save_path, filename=None):
        """
        Save the Grasshopper document to the specified path.

        Args:
            doc: The Grasshopper document to save
            save_path: The folder path where to save the document
            filename: Optional filename
                      (if None, generates timestamp-basedname)

        Returns:
            bool: True if successful, False otherwise
        """
        try:
            if doc is None:
                self._addError('Document is None, cannot save')
                return False, ''

            if not save_path:
                self._addError('Save path is empty')
                return False, ''

            # Handle relative paths - get the current GH
            # document directory as base
            current_doc = self.Component.OnPingDocument()
            if current_doc and current_doc.FilePath:
                current_dir = os.path.dirname(current_doc.FilePath)
                # Convert relative path to absolute path
                if not os.path.isabs(save_path):
                    save_path = os.path.normpath(
                        os.path.join(current_dir, save_path)
                    )
            else:
                # If no current document, use current working directory
                save_path = os.path.abspath(os.path.normpath(save_path))

            # Ensure the save directory exists
            if not os.path.exists(save_path):
                try:
                    os.makedirs(save_path, exist_ok=True)
                    self._addRemark(f'Created directory: {save_path}')
                except Exception as e:
                    self._addError(
                        f'Failed to create directory {save_path}: '
                        f'{str(e)}'
                    )
                    return False, ''

            # Generate filename if not provided
            if not filename:
                timestamp = datetime.now().strftime('%y%m%d_%H%M%S')
                filename = f'{timestamp}_ReleaseFile.gh'

            # Ensure filename has .gh extension
            if not filename.endswith('.gh'):
                filename += '.gh'

            # Create full file path
            full_path = os.path.join(save_path, filename)

            # Use GH_DocumentIO to save the document
            # (following SaveAndSaveGHX pattern)
            doc_io = Grasshopper.Kernel.GH_DocumentIO(doc)

            # Save the document
            success = doc_io.SaveQuiet(full_path)

            if success:
                self._addRemark(f'Document saved successfully: {full_path}')
                return True, full_path
            else:
                self._addError(f'Failed to save document to: {full_path}')
                return False, ''
        except Exception as e:
            self._addError(f'Error saving document: {str(e)}')
            return False, ''

    def validate_inputs(self, group_name, clear_panel_names, save_path):
        """
        Validate the input parameters.

        Args:
            group_name: The name of the group to remove
            save_path: The path where to save the document

        Returns:
            bool: True if inputs are valid, False otherwise
        """
        if not group_name or not group_name.strip():
            self._addError('Group name cannot be empty')
            return False

        if not save_path or not save_path.strip():
            self._addError('Save path cannot be empty')
            return False

        if not clear_panel_names:
            clear_panel_names = []
        for cpn in clear_panel_names:
            if not isinstance(cpn, str):
                self._addError('ClearPanelNames contains non-string')
                return False

        # Check if save path is valid
        try:
            # Handle relative paths - get the current
            # GH document directory as base
            current_doc = self.Component.OnPingDocument()
            if current_doc and current_doc.FilePath:
                current_dir = os.path.dirname(current_doc.FilePath)
                # Convert relative path to absolute path
                if not os.path.isabs(save_path):
                    normalized_path = os.path.normpath(
                        os.path.join(current_dir, save_path)
                    )
                else:
                    normalized_path = os.path.normpath(save_path)
            else:
                # If no current document, use current working directory
                normalized_path = os.path.abspath(os.path.normpath(save_path))
            # Check if the parent directory exists or can be created
            parent_dir = os.path.dirname(normalized_path)
            if parent_dir and not os.path.exists(parent_dir):
                # Try to create the parent directory
                try:
                    os.makedirs(parent_dir, exist_ok=True)
                except Exception:
                    self._addError(f'Cannot create directory: {parent_dir}')
                    return False
        except Exception as e:
            self._addError(f'Invalid save path: {str(e)}')
            return False

        return True

    def RunScript(self,
            Run: bool,
            SaveExamplesOnly: bool,
            RemoveGroupName: str,
            ClearPanelNames: System.Collections.Generic.List[str],
            ReleasePath: str,
            Filename: str,
            ExampleGroupNames: System.Collections.Generic.List[str],
            ExampleFileNames: System.Collections.Generic.List[str]):

        # Initialize output variables
        success = False
        components_removed = 0
        saved_file_path = ''
        status_message = ''

        # Check if execution is requested
        if not Run:
            status_message = 'Run is False - operation not performed'
            self.Component.Message = status_message
            return (success, components_removed, saved_file_path,
                    status_message)

        # Validate inputs
        if not self.validate_inputs(
                RemoveGroupName, ClearPanelNames, ReleasePath):
            status_message = 'Input validation failed'
            self.Component.Message = status_message
            return (success, components_removed, saved_file_path,
                    status_message)

        # Get the current Grasshopper document
        current_doc = self.Component.OnPingDocument()
        if current_doc is None:
            status_message = 'No active Grasshopper document found'
            self._addError(status_message)
            self.Component.Message = status_message
            return (success, components_removed, saved_file_path,
                    status_message)

        # Step 1: Copy the current document
        self.Component.Message = 'Copying document...'
        copied_doc = self.copy_document(current_doc)
        if copied_doc is None:
            status_message = 'Failed to copy document'
            self.Component.Message = status_message
            return (success, components_removed, saved_file_path,
                    status_message)

        # Step 2: Find the specified group
        self.Component.Message = 'Finding groups...'
        (target_groups,
            target_objects,
            target_panels) = self.find_groups_and_objects(
            copied_doc,
            RemoveGroupName,
            ClearPanelNames
        )
        if target_groups is None or target_objects is None:
            status_message = 'Failed to find groups and objects'
            self.Component.Message = status_message
            return (success, components_removed, saved_file_path,
                    status_message)

        # Step 3: Clear Panels if ClearPanelNames were supplied
        if target_panels:
            self.Component.Message = 'Clearing Panels...'
            panels_cleared = self.clear_panels(copied_doc, target_panels)
            if panels_cleared == 0:
                status_message = ('No panels have been cleared!')
                self._addWarning(status_message)

        # Step 4: Remove components from the group
        self.Component.Message = 'Removing components...'
        components_removed = self.remove_objects_from_doc(
            copied_doc,
            target_objects,
            target_groups
        )
        if components_removed == 0:
            status_message = (
                'No components were removed from '
                f'group "{RemoveGroupName}."'
            )
            self._addWarning(status_message)
        else:
            status_message = (
                f'Removed {components_removed} components from group '
                f'"{RemoveGroupName}."'
            )

        # Step 5: Save the modified document
        if SaveExamplesOnly:
            status_message += (
                '\n Skipped saving release file (SaveExamplesOnly).'
            )
        else:
            self.Component.Message = 'Saving document...'
            save_success, saved_file_path = self.save_document(
                copied_doc,
                ReleasePath,
                Filename
            )
            if save_success:
                saved_file_path = os.path.normpath(
                    os.path.abspath(saved_file_path)
                )
                success = True
                status_message += (
                    f'\n Saved release file to: {saved_file_path}'
                )
                self.Component.Message = 'Operation completed successfully'
            else:
                status_message += '\n Failed to save document!'
                self.Component.Message = 'Save operation failed'

        # Step 6: Create example files
        if ExampleGroupNames:
            self.Component.Message = 'Processing Example Exports...'
            for i, example_name in enumerate(ExampleGroupNames):
                example_doc = self.copy_document(current_doc)
                self.remove_all_groups_and_objects_except(
                    example_doc,
                    example_name
                )
                save_success, saved_file_path = self.save_document(
                    example_doc,
                    ReleasePath,
                    ExampleFileNames[i]
                )
                if save_success:
                    saved_file_path = os.path.normpath(
                        os.path.abspath(saved_file_path)
                    )
                    success = True
                    status_message += (
                        f'Saved example file to: {saved_file_path}'
                    )
                else:
                    status_message += ' Failed to save example document!'
        # set message
        self.Component.Message = 'Operation completed successfully'
        # return results
        return (success, components_removed, saved_file_path,
                status_message)
# ---------- end createreleasefiles ----------
status_message_stream_2 = Panel(createreleasefiles.Status)
success_message_2 = Panel(createreleasefiles.Success)
num_of_removed_gh_components = Panel(createreleasefiles.Removed)
filepath_of_saved_release_file_2 = Panel(createreleasefiles.SavedFilePath)

# ----
path_to_stipple_result = Panel(stippledviewcapture.StippledPath)
path_to_capture_result = Panel(stippledviewcapture.CapturePath)
path_to_normal_map = Panel(stippledviewcapture.NormalPath)
path_to_depth_map = Panel(stippledviewcapture.DepthPath)
