# Grasshopper definition Stippler_0.2.0.0.gh (Grasshopper 1.0.8)

# ----
# 1 -> CREATE PUBLIC DEV FILE
# comments & notes: Use this to create a public version without secrets from this development file. The component will create an in-memory copy of the GH Document, then clear all Panels which names are in "ClearPanelNames" and then save the document to the DevelopmentPath.
panel_names_to_clear = Panel("")
development_folder = Panel("..\grasshopper_development")
filename = Panel("Stippler_Grasshopperdevelopment_DEV_PUBLIC")
run = Button()
createpublicdevelopmentfile = CreatePublicDevelopmentFile(Run=run, ClearPanelNames=panel_names_to_clear, DevelopmentPath=development_folder, Filename=filename)  # -> out, Success, SavedFilePath, Status; inputs Run: Boolean, ClearPanelNames: list of String, DevelopmentPath: String, Filename: String
# ---------- createpublicdevelopmentfile: Python ----------
#! python3
# -*- coding: utf-8 -*-
# venv: DDU_CSC
print('ENV OK!')
# r: charset_normalizer
# r: requests

# PYTHON STANDARD LIBRARY IMPORTS ---------------------------------------------
import os  # NOQA
from datetime import datetime  # NOQA

# RHINO AND GH RELATED IMPORTS ------------------------------------------------
import System  # NOQA
import Grasshopper  # NOQA
import Rhino  # NOQA
import scriptcontext as sc  # NOQA

# GHENV COMPONENT SETTINGS ----------------------------------------------------
ghenv.Component.Name = 'CreatePublicDevelopmentFile'  # NOQA
ghenv.Component.NickName = 'CreatePublicDevelopmentFile'  # NOQA
ghenv.Component.Category = 'DDU_CSC'  # NOQA
ghenv.Component.SubCategory = '0 Development'  # NOQA
ghenv.Component.Description = (  # NOQA
    """
    This component can be used to create a sanitized Grasshopper
    development file in a specified folder.

    It creates a copy of the current Grasshopper document in
    memory, removes all components that belong to a specified group (i.e.
    developmclears specified panels containing sensitive information,
    and saves the modified document to a specified folder.

    The folder path can be relative, i.e. "..\\grasshopper_release".

    The filename can be specified, otherwise a timestamp-based filename will be
    generated.
    """
)


class CSC_CreatePublicDevelopmentFile(Grasshopper.Kernel.GH_ScriptInstance):
    """
    Author: Max Benjamin Eschenbach
    License: MIT License
    Version: 260609
    """

    def __init__(self):
        """Initialize this component and set component parameters."""
        super().__init__()
        # initialize props
        self.Component = ghenv.Component  # NOQA
        self.InputParams = self.Component.Params.Input
        self.OutputParams = self.Component.Params.Output

    def _addRemark(self, msg: str = ''):
        """Add a remark message to the component."""
        rml = self.Component.RuntimeMessageLevel.Remark
        self.AddRuntimeMessage(rml, msg)

    def _addWarning(self, msg: str = ''):
        """Add a warning message to the component."""
        rml = self.Component.RuntimeMessageLevel.Warning
        self.AddRuntimeMessage(rml, msg)

    def _addError(self, msg: str = ''):
        """Add an error message to the component."""
        rml = self.Component.RuntimeMessageLevel.Error
        self.AddRuntimeMessage(rml, msg)

    def BeforeRunScript(self):
        """Performs some setup actions."""
        # Initialize input param descriptions
        self.InputParams[0].Description = (
            'Run the document copy, object removal, and save operation'
        )
        self.InputParams[1].Description = (
            'List of names of optional GH_Panel objects to clear,'
            ' (i.e. for passwords)'
        )
        self.InputParams[2].Description = (
            'Folder path where to save the modified development document'
        )
        self.InputParams[3].Description = (
            'Optional filename for the saved document '
            '(without .gh extension)'
        )
        # Initialize output param descriptions
        i = 0
        if self.OutputParams[0].Name == 'out':
            i += 1
        self.OutputParams[0+i].Description = (
            'Success status of the operation (True/False)'
        )
        self.OutputParams[1+i].Description = (
            'Full path of the saved document'
        )
        self.OutputParams[2+i].Description = (
            'Status message describing the operation result'
        )

    def copy_document(self, source_doc):
        """
        Create a copy of the Grasshopper document in memory.

        Args:
            source_doc: The source Grasshopper document to copy

        Returns:
            GH_Document: A copy of the source document, or None if failed
        """
        try:
            if source_doc is None:
                self._addError('Source document is None')
                return None

            # Use the DuplicateDocument method to create a copy
            duplicate_doc = Grasshopper.Kernel.GH_Document.DuplicateDocument(
                source_doc
            )

            if duplicate_doc is None:
                self._addError('Failed to duplicate the document')
                return None

            self._addRemark('Successfully created document copy')
            return duplicate_doc

        except Exception as e:
            self._addError(f'Error copying document: {str(e)}')
            return None

    def clear_panels(self, doc, target_panels):
        """
        Clear all GH_Panel instances in the document with one of the specified
        names.
        """
        panels_cleared = 0
        try:
            # loop over target panels and clear them
            for panel in target_panels:
                # UserText property holds the panel contents so we clear it
                panel.UserText = ''
                # we clear the volatile data as well
                panel.ClearData()
                panels_cleared += 1
        except Exception as e:
            self._addError(f'Error clearing panels: {str(e)}')
            return panels_cleared
        # return target groups and objects
        return panels_cleared

    def find_panels_to_clear(self, doc, panel_names=[]):
        """
        Find all panels in the document with the specified name.
        """
        # get type for panels as string for verification
        paneltype = Grasshopper.Kernel.Special.GH_Panel
        paneltype_str = str(paneltype).split("'")[1]
        # loop over all document objects
        doc_objects = doc.Objects
        target_panels = []
        try:
            for doc_obj in doc_objects:
                # ensure matching panel name
                if panel_names and doc_obj.NickName in panel_names:
                    # ensure matching type
                    if str(doc_obj.GetType()) == paneltype_str:
                        target_panels.append(doc_obj)
        except Exception as e:
            self._addError(f'Error finding panels: {str(e)}')
            return None
        # return target panels
        return target_panels

    def save_document(self, doc, save_path, filename=None):
        """
        Save the Grasshopper document to the specified path.

        Args:
            doc: The Grasshopper document to save
            save_path: The folder path where to save the document
            filename: Optional filename
                      (if None, generates timestamp-basedname)

        Returns:
            bool: True if successful, False otherwise
        """
        try:
            if doc is None:
                self._addError('Document is None, cannot save')
                return False, ''

            if not save_path:
                self._addError('Save path is empty')
                return False, ''

            # Handle relative paths - get the current GH
            # document directory as base
            current_doc = self.Component.OnPingDocument()
            if current_doc and current_doc.FilePath:
                current_dir = os.path.dirname(current_doc.FilePath)
                # Convert relative path to absolute path
                if not os.path.isabs(save_path):
                    save_path = os.path.normpath(
                        os.path.join(current_dir, save_path)
                    )
            else:
                # If no current document, use current working directory
                save_path = os.path.abspath(os.path.normpath(save_path))

            # Ensure the save directory exists
            if not os.path.exists(save_path):
                try:
                    os.makedirs(save_path, exist_ok=True)
                    self._addRemark(f'Created directory: {save_path}')
                except Exception as e:
                    self._addError(
                        f'Failed to create directory {save_path}: '
                        f'{str(e)}'
                    )
                    return False, ''

            # Generate filename if not provided
            if not filename:
                timestamp = datetime.now().strftime('%y%m%d_%H%M%S')
                filename = f'{timestamp}_ReleaseFile.gh'

            # Ensure filename has .gh extension
            if not filename.endswith('.gh'):
                filename += '.gh'

            # Create full file path
            full_path = os.path.join(save_path, filename)

            # Use GH_DocumentIO to save the document
            # (following SaveAndSaveGHX pattern)
            doc_io = Grasshopper.Kernel.GH_DocumentIO(doc)

            # Save the document
            success = doc_io.SaveQuiet(full_path)

            if success:
                self._addRemark(f'Document saved successfully: {full_path}')
                return True, full_path
            else:
                self._addError(f'Failed to save document to: {full_path}')
                return False, ''
        except Exception as e:
            self._addError(f'Error saving document: {str(e)}')
            return False, ''

    def validate_inputs(self, clear_panel_names, save_path):
        """
        Validate the input parameters.

        Args:
            save_path: The path where to save the document

        Returns:
            bool: True if inputs are valid, False otherwise
        """
        if not save_path or not save_path.strip():
            self._addError('Save path cannot be empty')
            return False

        if not clear_panel_names:
            clear_panel_names = []
        for cpn in clear_panel_names:
            if not isinstance(cpn, str):
                self._addError('ClearPanelNames contains non-string')
                return False

        # Check if save path is valid
        try:
            # Handle relative paths - get the current
            # GH document directory as base
            current_doc = self.Component.OnPingDocument()
            if current_doc and current_doc.FilePath:
                current_dir = os.path.dirname(current_doc.FilePath)
                # Convert relative path to absolute path
                if not os.path.isabs(save_path):
                    normalized_path = os.path.normpath(
                        os.path.join(current_dir, save_path)
                    )
                else:
                    normalized_path = os.path.normpath(save_path)
            else:
                # If no current document, use current working directory
                normalized_path = os.path.abspath(os.path.normpath(save_path))
            # Check if the parent directory exists or can be created
            parent_dir = os.path.dirname(normalized_path)
            if parent_dir and not os.path.exists(parent_dir):
                # Try to create the parent directory
                try:
                    os.makedirs(parent_dir, exist_ok=True)
                except Exception:
                    self._addError(f'Cannot create directory: {parent_dir}')
                    return False
        except Exception as e:
            self._addError(f'Invalid save path: {str(e)}')
            return False

        return True

    def RunScript(self,
            Run: bool,
            ClearPanelNames: System.Collections.Generic.List[str],
            DevelopmentPath: str,
            Filename: str):

        # Initialize output variables
        success = False
        saved_file_path = ''
        status_message = ''

        # Check if execution is requested
        if not Run:
            status_message = 'Run is False - operation not performed'
            self.Component.Message = status_message
            return (success, saved_file_path,
                    status_message)

        # Validate inputs
        if not self.validate_inputs(
                ClearPanelNames, DevelopmentPath):
            status_message = 'Input validation failed'
            self.Component.Message = status_message
            return (success, saved_file_path,
                    status_message)

        # Get the current Grasshopper document
        current_doc = self.Component.OnPingDocument()
        if current_doc is None:
            status_message = 'No active Grasshopper document found'
            self._addError(status_message)
            self.Component.Message = status_message
            return (success, saved_file_path,
                    status_message)

        # Step 1: Copy the current document
        self.Component.Message = 'Copying document...'
        copied_doc = self.copy_document(current_doc)
        if copied_doc is None:
            status_message = 'Failed to copy document'
            self.Component.Message = status_message
            return (success, saved_file_path,
                    status_message)

        # Step 2: Find the panels to clear
        self.Component.Message = 'Finding groups...'
        target_panels = self.find_panels_to_clear(
            copied_doc, ClearPanelNames
        )

        # Step 3: Clear Panels if ClearPanelNames were supplied
        if target_panels:
            self.Component.Message = 'Clearing Panels...'
            panels_cleared = self.clear_panels(copied_doc, target_panels)
            if panels_cleared == 0:
                status_message = ('No panels have been cleared!')
                self._addWarning(status_message)

        # Step 4: Save the modified document
        self.Component.Message = 'Saving document...'
        save_success, saved_file_path = self.save_document(
            copied_doc,
            DevelopmentPath,
            Filename
        )
        if save_success:
            saved_file_path = os.path.normpath(
                os.path.abspath(saved_file_path)
            )
            success = True
            status_message += (
                f'\n Saved development file to: {saved_file_path}'
            )
            self.Component.Message = 'Operation completed successfully'
        else:
            status_message += '\n Failed to save document!'
            self.Component.Message = 'Save operation failed'

        # set message
        self.Component.Message = 'Operation completed successfully'
        # return results
        return (success, saved_file_path, status_message)
# ---------- end createpublicdevelopmentfile ----------
status_message_stream = Panel(createpublicdevelopmentfile.Status)
success_message = Panel(createpublicdevelopmentfile.Success)
filepath_of_saved_release_file = Panel(createpublicdevelopmentfile.SavedFilePath)

run_2 = BooleanToggle(False)
openfile = BooleanToggle(True)
width = Slider(720, range=0..10000)
height = Slider(480, range=0..10000)
# __DEVELOPMENT_CREDITS__: Authors: Max Benjamin Eschenbach
# 
# Digital Design Unit (DDU)
# Prof. Dr.-Ing. Oliver Tessmann
# Fachbereich Architektur
# Technical University of Darmstadt
# 
# CREDITS:
# ------------
toggle = BooleanToggle(False)
outputformat = ValueList({"PNG": 0, "SVF": 1, "PDF": 2}, selected="PNG")
# ENVIRONMENT SPEC: #! python3
# # -*- coding: utf-8 -*-
# # venv: STIPPLER
# print('ENV OK!')
# # r: charset_normalizer
# # r: git+https://github.com/fstwn/stippler.git@python39-rhino-port#subdirectory=code
number_slider = Slider(42, range=0..1000)
boundary = BooleanToggle(False)
silhouettedensity = BooleanToggle(False)
interior = BooleanToggle(True)
lighting = BooleanToggle(False)
depthattenuation = BooleanToggle(False)
gradientsize = BooleanToggle(False)
silhouettecurves = BooleanToggle(True)
source_folder = Panel("..\grasshopper_userobjects_xml")
stippledviewcapture = StippledViewCapture(
    Toggle=run_2,
    OpenFile=openfile,
    Width=width,
    Height=height,
    BackgroundColor=ColourSwatch(SwatchColor=RGB(255, 255, 255)),
    Grid=Toggle(False),
    WorldAxes=toggle,
    CPlaneAxes=Toggle(False),
    OutputFormat=outputformat,
    NumDots=Slider(60000, range=0..100000),
    Iterations=Slider(12, range=0..100),
    Gamma=Slider(1, range=0..10),
    RMin=Slider(1, range=0..10),
    RMax=Slider(6, range=0..10),
    SizeJitter=Slider(0.15, range=0..1),
    PositionJitter=Slider(0.1, range=0..1),
    EdgeNoise=Slider(0.1, range=0..1),
    Seed=number_slider,
    Dpi=Slider(300, range=0..1000),
    Boundary=boundary,
    SilhouetteDensity=silhouettedensity,
    Interior=interior,
    Lighting=lighting,
    DepthAttenuation=depthattenuation,
    GradientSize=gradientsize,
    SilhouetteCurves=silhouettecurves,
    CurveWidth=Slider(0.5, range=0..1))  # -> StippledPath, CapturePath, NormalPath, DepthPath; inputs Toggle: Boolean, OpenFile: Boolean, Width: Int32, Height: Int32, BackgroundColor: Color, Grid: Boolean, WorldAxes: Boolean, CPlaneAxes: Boolean, OutputFormat: Int32, NumDots: Int32, Iterations: Int32, Gamma: Double, RMin: Double, RMax: Double, SizeJitter: Double, PositionJitter: Double, EdgeNoise: Double, Seed: Int32, Dpi: Int32, Boundary: Boolean, SilhouetteDensity: Boolean, Interior: Boolean, Lighting: Boolean, DepthAttenuation: Boolean, GradientSize: Boolean, SilhouetteCurves: Boolean, NormalMap: String, DepthMap: String, LightDir: Vector3d, CurveWidth: Double
# ---------- stippledviewcapture: Python ----------
#! python3
# -*- coding: utf-8 -*-
# venv: STIPPLER
print('ENV OK!')
# r: charset_normalizer
# r: git+https://github.com/fstwn/stippler.git@python39-rhino-port#subdirectory=code


# PYTHON STANDARD LIBRARY IMPORTS ---------------------------------------------
import os  # NOQA
import datetime  # NOQA

# RHINO AND GH RELATED IMPORTS ------------------------------------------------
import System  # NOQA
import Rhino  # NOQA
import Grasshopper  # NOQA
import scriptcontext as sc  # NOQA

from stippler import (  # NOQA
    IllustrationParams,
    stipple,
    render_matplotlib,
    render_svg,
)

OUTPUT_FORMATS = {
    0: '.png',
    1: '.svg',
    2: '.pdf',
}

# GHENV COMPONENT SETTINGS ----------------------------------------------------
ghenv.Component.Name = 'StippledViewCapture'  # NOQA
ghenv.Component.NickName = 'StippledViewCapture'  # NOQA
ghenv.Component.Category = 'STIPPLER'  # NOQA
ghenv.Component.SubCategory = '1 Stippled Visualization'  # NOQA
ghenv.Component.Description = (  # NOQA
    'Captures the active Rhino viewport to PNG, then runs the stippler '
    'pipeline and writes a second file with the _stippled suffix. Supports '
    'PNG, SVG, and PDF stipple output, capture dimensions, background color, '
    'viewport visibility options, hand-drawn stippling controls, and '
    'optional Lu et al. scientific-illustration enhancements. Depth and '
    'normal auxiliary maps are captured automatically when the options that '
    'need them are enabled.'
)


class StippledViewCapture(Grasshopper.Kernel.GH_ScriptInstance):
    """
    Author: Max Benjamin Eschenbach
    License: MIT License
    Version: 260630
    """

    def __init__(self):
        super().__init__()
        self.Component = ghenv.Component  # NOQA
        self.InputParams = self.Component.Params.Input
        self.OutputParams = self.Component.Params.Output

    def _addRemark(self, msg: str = ''):
        """Add a remark message to the component runtime messages."""
        rml = self.Component.RuntimeMessageLevel.Remark
        self.AddRuntimeMessage(rml, msg)

    def _addWarning(self, msg: str = ''):
        """Add a warning message to the component runtime messages."""
        rml = self.Component.RuntimeMessageLevel.Warning
        self.AddRuntimeMessage(rml, msg)

    def _addError(self, msg: str = ''):
        """Add an error message to the component runtime messages."""
        rml = self.Component.RuntimeMessageLevel.Error
        self.AddRuntimeMessage(rml, msg)

    def _colorToHex(self, color):
        if color is None:
            return 'white'
        return '#%02x%02x%02x' % (color.R, color.G, color.B)

    def _resolveOptionalPath(self, path):
        if path is None:
            return None
        text = str(path).strip()
        if not text:
            return None
        return text

    def _needsDepthCapture(self, depth_attenuation, depth_override):
        return bool(depth_attenuation) and not depth_override

    def _needsNormalCapture(self, silhouette_density, lighting,
                            silhouette_curves, normal_override):
        if normal_override:
            return False
        return bool(silhouette_density or lighting or silhouette_curves)

    def _viewDirectionFromActiveView(self):
        """Return unit camera-to-target direction as (x, y, z)."""
        sc.escape_test()
        sc.doc = Rhino.RhinoDoc.ActiveDoc
        view = sc.doc.Views.ActiveView
        ghdoc = self.Component.OnPingDocument()
        sc.doc = ghdoc  # NOQA
        if view is None:
            return (0.0, 0.0, 1.0)
        camera = view.ActiveViewport.CameraLocation
        target = view.ActiveViewport.CameraTarget
        direction = target - camera
        if direction.IsTiny:
            direction = view.ActiveViewport.CameraZ
        direction.Unitize()
        return (direction.X, direction.Y, direction.Z)

    def _vector3dToTuple(self, vector, default=(1.0, 1.0, 1.0)):
        if vector is None:
            return default
        length = vector.Length
        if length < 1e-12:
            return default
        return (vector.X / length, vector.Y / length, vector.Z / length)

    def _buildIllustrationParams(
            self,
            boundary,
            silhouette_density,
            interior,
            lighting,
            depth,
            gradient_size,
            silhouette_curves,
            light_dir,
            view_dir,
            curve_width):
        return IllustrationParams(
            boundary=bool(boundary),
            silhouette_density=bool(silhouette_density),
            interior=bool(interior),
            lighting=bool(lighting),
            depth=bool(depth),
            gradient_size=bool(gradient_size),
            silhouette_curves=bool(silhouette_curves),
            light=light_dir,
            view=view_dir,
        ), curve_width

    def checkOrMakeFolder(self):
        """
        Check/makes a "Captures" folder in the GH def folder and a subfolder
        in the format 'YYMMDD'.
        """
        sc.escape_test()
        ghdoc = self.Component.OnPingDocument()
        date = datetime.date.today()
        yy = str(date.year)[-2:]
        mm = str(date.month).zfill(2)
        dd = str(date.day).zfill(2)
        timestamp = yy + mm + dd
        docpath = ghdoc.FilePath  # NOQA
        if docpath:
            folder = os.path.dirname(docpath)
            captureFolder = folder + "\\Captures\\" + timestamp
            if not os.path.isdir(captureFolder):
                os.makedirs(captureFolder)
            return captureFolder

    def makeFileName(self):
        """ Make a string with the gh def name + current hourMinuteSecond """
        n = datetime.datetime.now()
        ho, mt, sec = str(n.hour), str(n.minute), str(n.second)
        if len(ho) == 1:
            ho = "0" + ho
        if len(mt) == 1:
            mt = "0" + mt
        if len(sec) == 1:
            sec = "0" + sec
        hms = ho + mt + sec
        ghdoc = self.Component.OnPingDocument()
        ghDef = ghdoc.DisplayName.strip('*')
        return ghDef + '_' + hms

    def _resolveOutputFormat(self, format_code):
        if format_code is None:
            format_code = 0
        ext = OUTPUT_FORMATS.get(int(format_code))
        if ext is None:
            raise Exception(
                'OutputFormat must be 0 (PNG), 1 (SVG), or 2 (PDF).'
            )
        return ext

    def _viewCaptureBitmap(self, width, height, grid, world_axes, cplane_axes):
        """
        Capture the active Rhino view; caller must set sc.doc to RhinoDoc.
        """
        sc.escape_test()
        activeView = sc.doc.Views.ActiveView
        if activeView is None:
            raise Exception('No active Rhino viewport to capture.')
        viewcap = Rhino.Display.ViewCapture()
        viewcap.DrawGrid = grid
        viewcap.DrawGridAxes = world_axes
        viewcap.DrawAxes = cplane_axes
        viewcap.Height = height
        viewcap.Width = width
        bitmap = viewcap.CaptureToBitmap(activeView)
        if bitmap is None:
            raise Exception('ViewCapture returned an empty bitmap.')
        return bitmap

    def _saveBitmap(self, bitmap, path):
        bitmap.Save(path, System.Drawing.Imaging.ImageFormat.Png)

    def _captureWithToggleCommand(self, command, width, height, path):
        """
        Toggle a Rhino display command, ViewCapture, then toggle off.
        """
        sc.escape_test()
        ghdoc = self.Component.OnPingDocument()
        sc.doc = Rhino.RhinoDoc.ActiveDoc
        toggled_on = False
        try:
            if not Rhino.RhinoApp.RunScript(command, False):
                raise Exception('Rhino command failed: %s' % command)
            toggled_on = True
            bitmap = self._viewCaptureBitmap(
                width,
                height,
                False,
                False,
                False
            )
            self._saveBitmap(bitmap, path)
            Rhino.RhinoApp.WriteLine(path)
            return path
        finally:
            if toggled_on:
                Rhino.RhinoApp.RunScript(command, False)
            sc.doc = ghdoc  # NOQA

    def captureActiveViewToFile(
            self,
            width,
            height,
            path,
            grid,
            worldAxes,
            cplaneAxes):
        """Capture the shaded beauty pass."""
        sc.escape_test()
        ghdoc = self.Component.OnPingDocument()
        sc.doc = Rhino.RhinoDoc.ActiveDoc
        try:
            bitmap = self._viewCaptureBitmap(
                width, height, grid, worldAxes, cplaneAxes)
            self._saveBitmap(bitmap, path)
            Rhino.RhinoApp.WriteLine(path)
            sc.doc = ghdoc  # NOQA
            return path
        except Exception as e:
            sc.doc = ghdoc  # NOQA
            raise Exception(f'Capture failed, check the path: {str(e)}')

    def captureDepthMap(self, width, height, path):
        """Capture a grayscale depth map via ShowZBuffer + ViewCapture."""
        self._addRemark('Capturing depth map (ShowZBuffer)...')
        return self._captureWithToggleCommand(
            '_ShowZBuffer',
            width,
            height,
            path
        )

    def captureNormalMap(self, width, height, path):
        """Capture an RGB normal map via TestShowNormalMap + ViewCapture."""
        self._addRemark(
            'Capturing normal map (TestShowNormalMap). '
            'Monochrome or Arctic display mode works best.'
        )
        return self._captureWithToggleCommand(
            '_TestShowNormalMap', width, height, path)

    def stippleCapture(
            self,
            capture_path,
            output_path,
            output_ext,
            n_point,
            n_iter,
            gamma,
            r_min,
            r_max,
            size_jitter,
            position_jitter,
            edge_noise,
            seed,
            dpi,
            background,
            illustration,
            normal_map,
            depth_map,
            curve_width):
        """Run stippler on the capture and write the stippled output file."""
        sc.escape_test()
        result = stipple(
            capture_path,
            n_point=n_point,
            n_iter=n_iter,
            gamma=gamma,
            r_min=r_min,
            r_max=r_max,
            size_jitter=size_jitter,
            position_jitter=position_jitter,
            edge_noise=edge_noise,
            seed=seed,
            illustration=illustration,
            normal_map=normal_map,
            depth_map=depth_map,
        )
        if output_ext == '.svg':
            render_svg(
                result,
                output_path,
                background=background,
                curve_width=curve_width,
            )
        else:
            render_matplotlib(
                result,
                output_path,
                dpi=dpi,
                background=background,
                curve_width=curve_width,
            )
        return output_path, len(result.points), len(result.curves)

    def _setInputDescriptions(self):
        descriptions = [
            'Toggle to execute capture and stippling',
            'Open the stippled output file after creation',
            'Image width in pixels (default: 1920)',
            'Image height in pixels (default: 1080)',
            'Background color for the viewport capture and stipple output',
            'Show grid in the captured image',
            'Show world axes in the captured image',
            'Show construction plane axes in the captured image',
            'Stipple output format: 0=PNG (default), 1=SVG, 2=PDF',
            'Number of stipple dots (default: 5000)',
            ('Max Lloyd relaxation iterations; lower = '
             'looser spacing (default: 50)'),
            ('Density contrast curve; >1 concentrates '
             'dots in dark areas (default: 1.0)'),
            'Minimum dot radius in density-pixel units (default: 1.0)',
            'Maximum dot radius in density-pixel units (default: 1.0)',
            'Per-dot radius noise as a fraction, e.g. 0.15 (default: 0.0)',
            ('Gaussian positional noise std in '
             'density-pixel units (default: 0.0)'),
            ('Dot-edge wobble as a fraction of '
             'radius, e.g. 0.08 (default: 0.0)'),
            ('Random seed; 0 or less uses a '
             'non-deterministic seed (default: 0)'),
            'Raster output DPI for PNG/PDF stipple output (default: 300)',
            'Boost stipple density on high-gradient edges (Lu et al.)',
            'Boost density on silhouette regions; auto-captures normal map',
            'Sparse stipples in flat/low-gradient regions (Lu et al.)',
            'Modulate density from surface lighting; auto-captures normal map',
            'Attenuate far regions; auto-captures depth map (Lu et al.)',
            'Scale dot radius by local gradient magnitude (Lu et al.)',
            'Draw silhouette curves; auto-captures normal map when enabled',
            'Optional normal-map override path (skip auto-capture when set)',
            'Optional depth-map override path (skip auto-capture when set)',
            'Light direction for lighting enhancement (default: 1,1,1)',
            'Silhouette curve stroke width in output pixels (default: 0.6)',
        ]
        for index, text in enumerate(descriptions):
            if index < self.InputParams.Count:
                self.InputParams[index].Description = text

    def RunScript(self,
            Toggle: bool,
            OpenFile: bool,
            Width: int,
            Height: int,
            BackgroundColor: System.Drawing.Color,
            Grid: bool,
            WorldAxes: bool,
            CPlaneAxes: bool,
            OutputFormat: int,
            NumDots: int,
            Iterations: int,
            Gamma: float,
            RMin: float,
            RMax: float,
            SizeJitter: float,
            PositionJitter: float,
            EdgeNoise: float,
            Seed: int,
            Dpi: int,
            Boundary: bool,
            SilhouetteDensity: bool,
            Interior: bool,
            Lighting: bool,
            DepthAttenuation: bool,
            GradientSize: bool,
            SilhouetteCurves: bool,
            NormalMap: str,
            DepthMap: str,
            LightDir: Rhino.Geometry.Vector3d,
            CurveWidth: float):
        self._setInputDescriptions()
        self.OutputParams[0].Description = (
            'Path to the stippled output file (<name>_stippled.<ext>)'
        )
        if self.OutputParams.Count > 1:
            self.OutputParams[1].Description = (
                'Path to the original viewport capture PNG'
            )
        if self.OutputParams.Count > 2:
            self.OutputParams[2].Description = (
                'Path to the auto-captured normal map (<name>_normal.png), '
                'if created'
            )
        if self.OutputParams.Count > 3:
            self.OutputParams[3].Description = (
                'Path to the auto-captured depth map (<name>_depth.png), '
                'if created'
            )

        StippledPath = Grasshopper.DataTree[System.Object]()
        CapturePath = Grasshopper.DataTree[System.Object]()
        NormalPath = Grasshopper.DataTree[System.Object]()
        DepthPath = Grasshopper.DataTree[System.Object]()

        if not Toggle:
            self.Component.Message = (
                'Ready to capture view (toggle to execute)'
            )
            return StippledPath, CapturePath, NormalPath, DepthPath

        try:
            if BackgroundColor:
                settings = Rhino.ApplicationSettings.AppearanceSettings
                settings.ViewportBackgroundColor = BackgroundColor
                self._addRemark('Background color set for capture')

            if not Width:
                Width = 1920
            if not Height:
                Height = 1080
            if not NumDots:
                NumDots = 5000
            if not Iterations:
                Iterations = 50
            stipple_ext = self._resolveOutputFormat(OutputFormat)
            if Gamma is None:
                Gamma = 1.0
            if RMin is None:
                RMin = 1.0
            if RMax is None:
                RMax = 1.0
            if SizeJitter is None:
                SizeJitter = 0.0
            if PositionJitter is None:
                PositionJitter = 0.0
            if EdgeNoise is None:
                EdgeNoise = 0.0
            if not Dpi:
                Dpi = 300
            if CurveWidth is None or CurveWidth <= 0:
                CurveWidth = 0.6

            seed = Seed if Seed and Seed > 0 else None
            background = self._colorToHex(BackgroundColor)
            normal_map = self._resolveOptionalPath(NormalMap)
            depth_map = self._resolveOptionalPath(DepthMap)
            view_dir = self._viewDirectionFromActiveView()
            light_dir = self._vector3dToTuple(LightDir)

            capture_depth = self._needsDepthCapture(
                DepthAttenuation, depth_map)
            capture_normal = self._needsNormalCapture(
                SilhouetteDensity, Lighting, SilhouetteCurves, normal_map)

            illustration, curve_width = self._buildIllustrationParams(
                Boundary,
                SilhouetteDensity,
                Interior,
                Lighting,
                DepthAttenuation and (capture_depth or bool(depth_map)),
                GradientSize,
                SilhouetteCurves,
                light_dir,
                view_dir,
                CurveWidth,
            )

            self.Component.Message = 'Preparing capture...'

            capFolder = self.checkOrMakeFolder()
            if not capFolder:
                raise Exception(
                    'Save the Grasshopper definition first so a capture '
                    'folder can be created.'
                )

            fileName = self.makeFileName()
            capture_path = os.path.join(capFolder, fileName + '.png')
            depth_path = os.path.join(capFolder, fileName + '_depth.png')
            normal_path = os.path.join(capFolder, fileName + '_normal.png')
            stipple_path = os.path.join(
                capFolder, fileName + '_stippled' + stipple_ext
            )

            self.Component.Message = 'Capturing beauty pass...'
            captured_path = self.captureActiveViewToFile(
                Width, Height, capture_path, Grid, WorldAxes, CPlaneAxes
            )
            self._addRemark(f'Captured beauty pass to {captured_path}')

            if capture_depth:
                self.Component.Message = 'Capturing depth map...'
                depth_map = self.captureDepthMap(Width, Height, depth_path)
                self._addRemark(f'Captured depth map to {depth_map}')

            if capture_normal:
                self.Component.Message = 'Capturing normal map...'
                normal_map = self.captureNormalMap(Width, Height, normal_path)
                self._addRemark(f'Captured normal map to {normal_map}')

            self.Component.Message = 'Stippling...'
            output_path, dot_count, curve_count = self.stippleCapture(
                captured_path,
                stipple_path,
                stipple_ext,
                NumDots,
                Iterations,
                Gamma,
                RMin,
                RMax,
                SizeJitter,
                PositionJitter,
                EdgeNoise,
                seed,
                Dpi,
                background,
                illustration,
                normal_map,
                depth_map,
                curve_width,
            )
            self._addRemark(
                f'Stippled {dot_count} dots and {curve_count} curves to '
                f'{output_path}'
            )

            ghp = Grasshopper.Kernel.Data.GH_Path(0)
            StippledPath.Add(output_path, ghp)
            CapturePath.Add(captured_path, ghp)
            if normal_map:
                NormalPath.Add(normal_map, ghp)
            if depth_map:
                DepthPath.Add(depth_map, ghp)

            if OpenFile:
                os.startfile(output_path)
                self._addRemark('Stippled file opened')

            self.Component.Message = (
                f'Saved: {dot_count} dots, {curve_count} curves'
            )
            Rhino.RhinoApp.WriteLine(captured_path)
            if depth_map:
                Rhino.RhinoApp.WriteLine(depth_map)
            if normal_map:
                Rhino.RhinoApp.WriteLine(normal_map)
            Rhino.RhinoApp.WriteLine(output_path)
            return StippledPath, CapturePath, NormalPath, DepthPath

        except Exception as e:
            msg = f'Capture/stipple failed: {str(e)}'
            self._addError(msg)
            self.Component.Message = msg
            return StippledPath, CapturePath, NormalPath, DepthPath
# ---------- end stippledviewcapture ----------
path_to_stipple_result = Panel(stippledviewcapture.StippledPath)
path_to_capture_result = Panel(stippledviewcapture.CapturePath)
path_to_normal_map = Panel(stippledviewcapture.NormalPath)
path_to_depth_map = Panel(stippledviewcapture.DepthPath)
